# Grasshopper definition 5_PressureOnBuildingFacade.ghx (Grasshopper 1.0.8)
# plug-ins: Eddy3D

c_script = CSharpScript()  # -> out, epwPath; inputs url: String, saveTo: String
# ---------- c_script: C# ----------
using System;
using System.IO;
using System.Net;
using System.Net.Http;
using System.Linq;
using System.Collections;
using System.Collections.Generic;
using System.Runtime.InteropServices;

public class Script_Instance : GH_ScriptInstance
{

private void RunScript(string url, string saveTo, ref object epwPath){
  

epwPath = null;

    // --- 1. Validate URL ---
    if (string.IsNullOrWhiteSpace(url))
    {
        Print("Error: URL is empty.");
        return;
    }

    // --- 2. Determine Filename ---
    string fileName = "download.epw";
    try
    {
        if (Uri.TryCreate(url, UriKind.Absolute, out Uri uri))
            fileName = Path.GetFileName(uri.LocalPath);
        if (string.IsNullOrWhiteSpace(fileName)) fileName = "default.epw";
    }
    catch { }

    // --- 3. Determine Initial Directory ---
    string targetDir = string.Empty;

    // If 'saveTo' input is connected, try that first
    if (!string.IsNullOrWhiteSpace(saveTo))
    {
        targetDir = saveTo;
    }
    else
    {
        // Otherwise, try the Grasshopper File location
        var ghDoc = this.GrasshopperDocument;
        if (ghDoc != null && !string.IsNullOrEmpty(ghDoc.FilePath))
        {
            string ghDir = Path.GetDirectoryName(ghDoc.FilePath);
            string caseDir = Path.Combine(ghDir, "Case");
            targetDir = Directory.Exists(caseDir) ? caseDir : ghDir;
        }
        else
        {
            // If unsaved, go straight to Fallback
            targetDir = GetEddy3DWeatherPath();
        }
    }

    // --- 4. Robust Directory Creation (The Fix) ---
    // We try to create the target directory. If it fails (Access Denied/Bad Path),
    // we AUTOMATICALLY fallback to the safe User AppData folder.
    try
    {
        targetDir = targetDir.Trim().Trim('"');
        targetDir = Environment.ExpandEnvironmentVariables(targetDir);

        if (!Directory.Exists(targetDir))
        {
            Directory.CreateDirectory(targetDir);
        }
    }
    catch (System.UnauthorizedAccessException)
    {
        Print($"Access Denied to: {targetDir}");
        Print("Switched to safe default folder.");
        targetDir = GetEddy3DWeatherPath();
        Directory.CreateDirectory(targetDir); // Force create safe dir
    }
    catch (Exception ex)
    {
        Print($"Invalid path ({ex.Message}). Switched to default.");
        targetDir = GetEddy3DWeatherPath();
        Directory.CreateDirectory(targetDir);
    }

    // --- 5. Download Logic ---
    string finalPath = Path.Combine(targetDir, fileName);

    try
    {
        if (File.Exists(finalPath))
        {
            Print($"File exists: {finalPath}");
            epwPath = finalPath;
            return;
        }

        Print($"Downloading to: {finalPath}");
        
        using (var client = new WebClient())
        {
            client.DownloadFile(url, finalPath);
        }
        
        Print("Download complete.");
        epwPath = finalPath;
    }
    catch (Exception ex)
    {
        Print($"Download Error: {ex.Message}");
    }

}

// Helper to get the correct Eddy3D/Weather path on Mac or Windows
private string GetEddy3DWeatherPath()
{
    string basePath;
    bool isMac = RuntimeInformation.IsOSPlatform(OSPlatform.OSX);

    if (isMac)
    {
        // macOS: ~/Library/Application Support/Eddy3D/Weather
        string home = Environment.GetEnvironmentVariable("HOME");
        basePath = Path.Combine(home, "Library", "Application Support");
    }
    else
    {
        // Windows: %AppData%/Eddy3D/Weather
        basePath = Environment.GetFolderPath(Environment.SpecialFolder.ApplicationData);
    }

    return Path.Combine(basePath, "Eddy3D", "Weather");
}
}
# ---------- end c_script ----------
panel = Panel("https://energyplus-weather.s3.amazonaws.com/asia_wmo_region_2/IND/IND_Ahmedabad.426470_IWEC/IND_Ahmedabad.426470_IWEC.epw")

# ----
# 1. Geometry &
# Boundary Conditions
panel_2 = Panel("""0
45
90
135
180
225
270
320""")

abl = ABLFlow(WindDirections=panel_2, WeatherFile=panel)
cluster = Cluster_2()

# ----
# 2. Simulation Domain
number_slider = Slider(40, range=0..1000)

domcyl = CylindricalDomain(
    Buildings=cluster,
    BoundaryCondition=abl,
    CellSize="15",
    InnerSize=number_slider,
    OuterRadius=Slider(519, range=0..1000),
    Height=Slider(80, range=0..1000),
    RadialMultiplier=2,
    XDivisions=1)  # -> Domain, PreviewMesh
cellsz = MeshCellSize(Domain=domcyl.Domain, BaseCellSize="15", TargetCellSize=Slider(2, range=0..10))  # -> RefinementLevel, RefinementLevel1

# ----
# 3. Mesh & Simulation
button = Button()

windsim = WindSimulation(
    SimulationDomain=domcyl.Domain,
    WorkingDirectory="C:\Users\pkastner\Eddy",
    RunMeshing=Button(),
    MakeTrees=False,
    RunSimulation=button)  # -> SimulationResult, MeshDone, SimDone, MeshETA, SimETA
qrmesh = QuadRemesh(Geometry=cluster, Settings={aqc=True, as=50, dhe=True, gci=0, null=False, pme=2, sa=0, tqc=2000})
demesh = DeconstructMesh(Mesh=qrmesh)  # -> Vertices, Faces, Colours, Normals

# ----
# 4.2. Probing points & probing
panel_3 = Panel("pressure100")

probing = Probing(
    Result=windsim.SimulationResult,
    ProbingPoints=demesh.Vertices,
    NameOfInstance=panel_3,
    InterpolationScheme=2,
    NameOfField=1,
    Run=Button())  # -> ProbingPoints, ProbingResult

# ----
# 6. Clean
button_2 = Button()
clean = CleanDirectories(ResultDirectory=windsim.SimulationResult, Mode=0, Run=button_2)

# ----
# 5. Post-processing
# 5.1. Change wind direction
number_slider_2 = Slider(6, range=0..7)
branch = TreeBranch(Tree=probing.ProbingResult, Path=number_slider_2, MaintainPaths=True)
cluster_2 = Cluster(data=branch)  # -> S, E, data_3
gradient = Gradient(
    LowerLimit="-1",
    UpperLimit="1",
    Parameter=cluster_2.data_3,
    stops=[0.103: RGB(0, 0, 255), 0.22: RGB(0, 170, 255), 0.305: RGB(0, 255, 255), 0.398: RGB(0, 255, 188), 0.504: RGB(0, 255, 106), 0.605: RGB(91, 255, 0), 0.699: RGB(184, 255, 0), 0.799: RGB(255, 255, 0), 0.898: RGB(255, 170, 0)])
conmesh = ConstructMesh(Vertices=demesh.Vertices, Faces=demesh.Faces, Colours=gradient)

# ==== cluster Cluster
data = ClusterInput()
data_2 = Data(data)
data_3 = ClusterOutput(data_2)
bnd = Bounds(Numbers=data_2)
dedomain = DeconstructDomain(Domain=bnd)  # -> Start, End
S = ClusterOutput(dedomain.Start)
E = ClusterOutput(dedomain.End)

# ==== cluster Cluster_2
geo = Geometry([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])
mesh = Mesh(geo)
mjoin = MeshJoin(Meshes=mesh)
M = ClusterOutput(mjoin)
