# Grasshopper definition SimpleWall.ghx (Grasshopper 1.0.8)
# plug-ins: Outdoor, Eddy3D, Eddy3D-Radiance, Eddy3D-Esinti, Eddy3D-Indoor

esinti = Esinti(EsintiAgent="Claude")
select_template = SelectTemplate()
# Description: Conjugate heat transfer through a two-layer brick wall, after Kastner and Dogan (SimAUD 2020). Two Box 2Pt blocks, 0.15 m thick and 1 m square, become CHT Solid regions with CHT Material Brick. CHT Boundary components hold the west face at 20 degC and the east at -5 degC; unassigned faces stay adiabatic. CHT Case starts at 10 degC with 0.05 m background cells for 10000 s. Run solves in a Docker or Podman container while Live Residuals tracks convergence. Probe reads T on the wall region at Brep Grid Points, drawn by Scalar Field Viewer. Edit boxes, materials, temperatures.
eddy3d_setup = Eddy3DSetup(Open=False)
pt = ConstructPoint(XCoordinate=0, YCoordinate=0, ZCoordinate=0)
pt_2 = ConstructPoint(XCoordinate=0.15, YCoordinate=1, ZCoordinate=1)
pt_3 = ConstructPoint(XCoordinate=0.15, YCoordinate=0, ZCoordinate=0)
pt_4 = ConstructPoint(XCoordinate=0.3, YCoordinate=1, ZCoordinate=1)
chtmat = CHTMaterial(Material="Brick")
chtmat_2 = CHTMaterial(Material="Brick")
box = Box2Pt(PointA=pt, PointB=pt_2, Plane=PlaneXY(0, 0, 0))
box_2 = Box2Pt(PointA=pt_3, PointB=pt_4, Plane=PlaneXY(0, 0, 0))
wires = BrepWireframe(Brep=box_2, Density=-1)
wires_2 = BrepWireframe(Brep=box, Density=-1)
chtsolid = CHTSolid(Geometry=box, Name="wall", Material=chtmat)  # -> Solid, InsidePoint
chtsolid_2 = CHTSolid(Geometry=box_2, Name="outer", Material=chtmat_2)  # -> Solid, InsidePoint
chtbc = CHTBoundary(Face="X- (west)", Type="Fixed Temperature", Temperature=20, HeatTransferCoefficient=10)
chtbc_2 = CHTBoundary(Face="maxX", Type="Fixed Temperature", Temperature=-5, HeatTransferCoefficient=10)
merge = Merge(Data1=chtbc, Data2=chtbc_2)
merge_2 = Merge(Data1=chtsolid.Solid, Data2=chtsolid_2.Solid)
chtcase = CHTCase(
    CaseName="CHT",
    Solids=merge_2,
    Boundaries=merge,
    CellSize=0.05,
    Refinement=1,
    InitialTemperature=10,
    Duration=10000,
    SteadyState=False,
    Write=False,
    Clear=False,
    ChtInputLayoutVersion=2)  # -> CaseDirectory, Commands, Logs, Case
panel = Panel(chtcase.Logs)
reslive = LiveResiduals(Case=chtcase.Case, Live=True, DirectionDegrees=-1)
run = Run(Case=chtcase.Case, Mesh=False, Simulate=False, RunAll=False, Parallel=True, DirectionIndex=-1, ShowZones=False)
geometry = Geometry(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)
brep_grid_points = BrepGridPoints(Geometry=geometry, Spacing=0.05)  # -> Points, Vectors, Mesh, Status
probe = Probe(
    Case=chtcase.Case,
    Points=brep_grid_points.Points,
    Field="T",
    Region="wall",
    Run=Button(),
    AutoProbeName="fresh-salmon-delta-mirror",
    BakeTimeHistory=False,
    CullHugeVectors=True,
    CullInvalid=True,
    ShowRegion=True)  # -> Values, TimeSteps, SubResults
scalar_field_viewer = ScalarFieldViewer(Points=brep_grid_points.Points, Values=probe.Values, DisplayMode="Point Cloud", PointSize=4, ColorMap="Viridis")  # -> Geometry, Colors, Range
