# Grasshopper definition BoxRoom.ghx (Grasshopper 1.0.8)
# plug-ins: Outdoor, Eddy3D-Indoor

ground_roughness = GroundRoughness(RefinementLevel=2)
geometry = Geometry(<surface referenced from the Rhino model>)
geometry_2 = Geometry(<surface referenced from the Rhino model>)
geometry_3 = Geometry(<surface referenced from the Rhino model>)
indoor_wall = IndoorWall(Temperature="40", Surface=geometry)  # -> WallTemperature, Wall
indoor_inlet = IndoorInlet(Surface=geometry_3, Speed=0.5, Temperature=20)
indoor_outlet = IndoorOutlet(Surface=geometry_2)
brep = Brep(<brep referenced from the Rhino model>)
indoor_case = IndoorCase(
    CaseName="indoor",
    Room=brep,
    CellSize=0.25,
    Inlets=indoor_inlet,
    Outlets=indoor_outlet,
    InletSpeed=0.5,
    WallTemp=indoor_wall.WallTemperature,
    Write=Button(),
    Clear=False,
    Walls=indoor_wall.Wall)  # -> Case, Logs
run = Run(
    Case=indoor_case.Case,
    Mesh=False,
    Simulate=False,
    RunAll=False,
    Parallel=True,
    Engine="Docker",
    DirectionIndex=-1,
    ShowZones=False)
