# Grasshopper definition CO2_Occupancy.ghx (Grasshopper 1.0.8)
# plug-ins: Outdoor, Eddy3D-Indoor

occco2 = OccupantCO2(
    Age=25,
    MetabolicRate=1.2,
    Sex=0,
    BreathingFlow=7.2,
    Breaths=12,
    Activity="Custom (Met input)",
    SexChoice="Custom (Sex input)")  # -> Occupant, CO2Rate, ExhaledCO2, BodyMass, BMR, BodySurfaceArea, TidalVolume
# INDOOR CO2 + OCCUPANCY
# Two CO2 paths on one canvas. Units: METERS.
# 
# CFD PATH (top): room 6 x 4 x 3 m, inlet 1 m2 at
# 0.5 m/s on x=0, outlet on x=6, cell size 0.3 m.
# CO2 Emitter zone box (4,1,1)-(5,3,2), injection
# rate 1.076e-4. Solves on the incompressible
# solver: CO2 is a passive scalar, not buoyant.
# Numbers from TestIndoorEmittersContainerE2E.
# 
# ANALYTIC PATH (bottom): Occupant CO2 at age 25,
# 1.2 met, sex average -> 0.0043 L/s, the Persily
# & de Jonge row pinned in TestIndoorAirQuality.
# CO2 Air Quality grades 950 ppm against 400 ppm
# outdoor on EN 16798-1 -> delta 550 -> Category I,
# the exact boundary the unit test pins.
# 
# KNOWN WARNING: Indoor Case reports the emitter
# zone is 1 m at its thinnest against the 1.2 m
# background cell (4 x cell size). That is the
# fixture's own zone; the fixture asserts the zone
# does select cells after snappy refinement. Lower
# Cell Size if you widen the room.
# 
# Occupant count is not an input on either CO2
# component - see Window Air Exchange for that.
# 
# Action toggles ship OFF.
pt = ConstructPoint(XCoordinate=0, YCoordinate=0, ZCoordinate=0)
pt_2 = ConstructPoint(XCoordinate=6, YCoordinate=4, ZCoordinate=3)
pt_3 = ConstructPoint(XCoordinate=0, YCoordinate=2, ZCoordinate=1.5)
pt_4 = ConstructPoint(XCoordinate=6, YCoordinate=2, ZCoordinate=1.5)
dom = ConstructDomain(DomainStart=-0.5, DomainEnd=0.5)
pt_5 = ConstructPoint(XCoordinate=4, YCoordinate=1, ZCoordinate=1)
pt_6 = ConstructPoint(XCoordinate=5, YCoordinate=3, ZCoordinate=2)
yz = YZPlane(Origin=pt_3)
yz_2 = YZPlane(Origin=pt_4)
box = Box2Pt(PointA=pt, PointB=pt_2, Plane=PlaneXY(0, 0, 0))
box_2 = Box2Pt(PointA=pt_5, PointB=pt_6, Plane=PlaneXY(0, 0, 0))
planesrf = PlaneSurface(Plane=yz, XSize=dom, YSize=dom)
planesrf_2 = PlaneSurface(Plane=yz_2, XSize=dom, YSize=dom)
co2 = CO2Emitter(Zone=box_2, InjectionRate=0.0001076)
iaq = CO2AirQuality(IndoorCO2=950, OutdoorCO2=400, Standard=0, StandardName="Custom (Standard input)")  # -> Index, Class, Source
inlet = IndoorInlet(Surface=planesrf, Speed=0.5, Temperature=20)
outlet = IndoorOutlet(Surface=planesrf_2)
indoor = IndoorCase(
    CaseName="indoorEmit",
    Room=box,
    CellSize=0.3,
    Inlets=inlet,
    Outlets=outlet,
    InletSpeed=0.5,
    Sources=co2,
    Write=False,
    Clear=False,
    AutoName="brave-badger-ridge-lantern",
    IndoorInputLayoutVersion=2)  # -> Case, Logs
run = Run(
    Case=indoor.Case,
    Mesh=False,
    Simulate=False,
    RunAll=False,
    Parallel=True,
    Engine="Containerized",
    DirectionIndex=-1,
    ShowZones=False)
