# Grasshopper definition Validation_Zhang_Chen_UFAD.ghx (Grasshopper 1.0.8)
# plug-ins: Outdoor, Eddy3D-Indoor

split = TextSplit(Text="1.105,2.155,3.205,1.105,2.155,3.205", Separators=",")
# Description: Purpose: Check the indoor solver against measured underfloor air distribution in a test chamber.
# Fidelity: Validated against measurements. Cite: Zhang and Chen, Atmospheric Environment 2006. Diffuser, occupant and luminaire positions are reconstructed.
# Method: Steady buoyant RANS of a 4.91 x 4.31 x 2.44 m chamber: two floor diffusers at 0.70 m/s, ceiling extract, occupants, luminaires.
# Result: Vertical temperature profile; expect roughly 1.1 to 1.7 K/m from floor to ceiling.
# Needs: Eddy3D Setup > (U)RANS CFD (OpenFOAM). Runtime: about an hour.
# Edit: Nothing for the comparison itself; Cell Size (0.10 m default) for a grid-sensitivity study.
panel = Panel("0.955,3.955,0.955,3.955")
pt = ConstructPoint(XCoordinate=2.455, YCoordinate=2.155, ZCoordinate=1.22)
pt_2 = ConstructPoint(XCoordinate=2.205, YCoordinate=1.905, ZCoordinate=2.44)
xy = XYPlane(Origin=pt)
xy_2 = XYPlane(Origin=pt_2)
split_2 = TextSplit(Text=panel, Separators=",")
split_3 = TextSplit(Text="0.655,0.655,3.655,3.655", Separators=",")
pt_3 = ConstructPoint(XCoordinate=split_2, YCoordinate=split_3, ZCoordinate=0.45)
xy_3 = XYPlane(Origin=pt_3)
split_4 = TextSplit(Text="1.205,1.205,1.205,3.705,3.705,3.705", Separators=",")
split_5 = TextSplit(Text="0,4.31", Separators=",")
pt_4 = ConstructPoint(XCoordinate=0, YCoordinate=split_5, ZCoordinate=0)
xz = XZPlane(Origin=pt_4)
split_6 = TextSplit(Text="25.3,25.5", Separators=",")
split_7 = TextSplit(Text="west,east", Separators=",")
split_8 = TextSplit(Text="0.825,3.825", Separators=",")
pt_5 = ConstructPoint(XCoordinate=split_8, YCoordinate=2.025, ZCoordinate=0)
xy_4 = XYPlane(Origin=pt_5)
split_9 = TextSplit(Text="20.4,19.9", Separators=",")
pt_6 = ConstructPoint(XCoordinate=split_4, YCoordinate=split, ZCoordinate=2.43)
xy_5 = XYPlane(Origin=pt_6)
pt_7 = ConstructPoint(XCoordinate=0, YCoordinate=0, ZCoordinate=2.44)
xy_6 = XYPlane(Origin=pt_7)
box = CenterBox(Base=xy, X=2.455, Y=2.155, Z=1.22)
box_2 = CenterBox(Base=xy_3, X=0.19, Y=0.19, Z=0.45)
planesrf = PlaneSurface(Plane=xz, XSize=Domain(-10, 10), YSize=Domain(-10, 10))
planesrf_2 = PlaneSurface(Plane=xy_6, XSize=Domain(-10, 10), YSize=Domain(-10, 10))
planesrf_3 = PlaneSurface(Plane=xy_4, XSize=Domain(-10, 10), YSize=Domain(-10, 10))
planesrf_4 = PlaneSurface(Plane=xy_2, XSize=Domain(-10, 10), YSize=Domain(-10, 10))
wall = IndoorWall(Temperature=split_6, Surface=planesrf, Name=split_7)  # -> WallTemperature, Wall
inlet = IndoorInlet(Surface=planesrf_3, Speed=0.6982, Temperature=split_9)
wall_2 = IndoorWall(Temperature=24)  # -> WallTemperature, Wall
outlet = IndoorOutlet(Surface=planesrf_4)
split_10 = TextSplit(Text="manikin1,manikin2,manikin3,manikin4", Separators=",")
wall_3 = IndoorWall(Temperature=20, Surface=box_2, Name=split_10, Power=100)  # -> WallTemperature, Wall
split_11 = TextSplit(Text="lamp1,lamp2,lamp3,lamp4,lamp5,lamp6", Separators=",")
split_12 = TextSplit(Text="0,4.91", Separators=",")
pt_8 = ConstructPoint(XCoordinate=split_12, YCoordinate=0, ZCoordinate=0)
yz = YZPlane(Origin=pt_8)
planesrf_5 = PlaneSurface(Plane=yz, XSize=Domain(-10, 10), YSize=Domain(-10, 10))
split_13 = TextSplit(Text="25.0,24.9", Separators=",")
split_14 = TextSplit(Text="south,north", Separators=",")
wall_4 = IndoorWall(Temperature=split_13, Surface=planesrf_5, Name=split_14)  # -> WallTemperature, Wall
box_3 = CenterBox(Base=xy_5, X=0.5, Y=0.075, Z=0.01)
wall_5 = IndoorWall(Temperature=20, Surface=box_3, Name=split_11, Power=64)  # -> WallTemperature, Wall
wall_6 = IndoorWall(Temperature=25.7, Surface=planesrf_2, Name="ceiling")  # -> WallTemperature, Wall
indoor = IndoorCase(
    CaseName="ZhangChenUFAD",
    Room=box,
    CellSize=Slider(0.1, range=0.02..0.3),
    Inlets=inlet,
    Outlets=outlet,
    InletSpeed=0.5,
    WallTemp=wall_2.WallTemperature,
    Walls=wall_5.Wall,
    AgeOfAir=False,
    Engine="BlueCFD",
    Write=False,
    Clear=False,
    IndoorInputLayoutVersion=6,
    RepairGeometry=True)  # -> Case, Logs
run = Run(Case=indoor.Case, Mesh=False, Simulate=False, RunAll=False, Parallel=True, DirectionIndex=-1, ShowZones=False)
