# Grasshopper definition 9_ML_Inference.ghx (Grasshopper 1.0.8)
# plug-ins: Eddy3D

path = FilePath("C:\Users\ilker\Desktop\Conditional_Transformer\Pix2PixHD_Model\HF_Token.txt")

# ---- group: Geometry Input
list = ValueList({"Architectural Insitute of Japan - Case E": 0, "OpenFOAM - Wind Around Buildings": 1, "Eddy3D Validation Sample": 2}, selected="Architectural Insitute of Japan - Case E")
brep = Brep([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])
brep_2 = Brep([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])
brep_3 = Brep([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])
entwine = Entwine(Branch00=brep, Branch01=brep_2, Branch02=brep_3, FlattenInputs=True)  # -> simplify(Result)
branch = TreeBranch(Tree=entwine, Path=list, MaintainPaths=True)

# ---- group: Yel-1.0
yel_1_0 = CSharpScript(Run=True, Force=False)  # -> Status, FilePath, Progress; inputs Run: Boolean, Force: Boolean
# ---------- yel_1_0: C# ----------
// Grasshopper Script Instance
#region Usings
using System;
using System.IO;
using System.Diagnostics;
using System.Runtime.InteropServices;

using Rhino;
using Rhino.Geometry;

using Grasshopper;
using Grasshopper.Kernel;
using Grasshopper.Kernel.Data;
using Grasshopper.Kernel.Types;
#endregion

public class Script_Instance : GH_ScriptInstance
{
  private void RunScript(
		bool Run,
		bool Force,
		ref object Status,
		ref object FilePath,
		ref object Progress)
  {
    string modelUrl = "https://huggingface.co/SustainableUrbanSystemsLab/Yel/resolve/main/Yel.onnx";
    string modelFileName = "Yel.onnx";

    Progress = 0.0;

    try
    {
      if (!Run)
      {
        Status = "Set Run to True to download the model.";
        FilePath = null;
        Progress = 0.0;
        Component.Message = "Idle";
        return;
      }

      string userFolder = Environment.GetFolderPath(Environment.SpecialFolder.UserProfile);

      if (string.IsNullOrWhiteSpace(userFolder) || !Directory.Exists(userFolder))
      {
        Status = "Could not locate the user home folder.";
        FilePath = null;
        Progress = 0.0;
        Component.Message = "Error";
        return;
      }

      string modelFolder = Path.Combine(userFolder, "SUS_LAB");

      if (!Directory.Exists(modelFolder))
      {
        Directory.CreateDirectory(modelFolder);
      }

      string destinationPath = Path.Combine(modelFolder, modelFileName);
      string tempPath = destinationPath + ".download";

      FilePath = destinationPath;

      // Cache check
      if (File.Exists(destinationPath) && !Force)
      {
        FileInfo existingFile = new FileInfo(destinationPath);

        Status =
          "Model already exists. Using cached file.\n" +
          "Path: " + destinationPath + "\n" +
          "Size: " + Math.Round(existingFile.Length / 1024.0 / 1024.0, 2) + " MB\n" +
          "Set Force to True to re-download and replace it.";

        Progress = 100.0;
        Component.Message = "Cached";
        return;
      }

      if (File.Exists(tempPath))
      {
        File.Delete(tempPath);
      }

      Component.Message = "Downloading";
      Status = "Downloading model. Please wait...";

      bool isWindows = RuntimeInformation.IsOSPlatform(OSPlatform.Windows);
      bool isMac = RuntimeInformation.IsOSPlatform(OSPlatform.OSX);

      string curlPath = "";

      if (isWindows)
      {
        curlPath = "curl.exe";
      }
      else if (isMac)
      {
        curlPath = "/usr/bin/curl";
      }
      else
      {
        Status = "Unsupported operating system. This script currently supports Windows and macOS.";
        FilePath = null;
        Progress = 0.0;
        Component.Message = "Error";
        return;
      }

      ProcessStartInfo psi = new ProcessStartInfo();

      psi.FileName = curlPath;

      // -L follows Hugging Face redirects
      // --fail returns an error code for failed HTTP requests
      // --http1.1 avoids some HTTP/2 issues
      // --retry helps with unstable connections
      // --connect-timeout avoids hanging forever
      psi.Arguments =
        "-L --fail --show-error --http1.1 " +
        "--retry 3 --retry-delay 2 --connect-timeout 30 " +
        "-A \"Grasshopper-Yel-Model-Downloader\" " +
        "\"" + modelUrl + "\" " +
        "-o " +
        "\"" + tempPath + "\"";

      psi.UseShellExecute = false;
      psi.CreateNoWindow = true;
      psi.RedirectStandardOutput = true;
      psi.RedirectStandardError = true;

      using (Process process = new Process())
      {
        process.StartInfo = psi;
        process.Start();

        while (!process.HasExited)
        {
          if (File.Exists(tempPath))
          {
            FileInfo partialFile = new FileInfo(tempPath);
            double downloadedMB = partialFile.Length / 1024.0 / 1024.0;

            Status =
              "Downloading model...\n" +
              "Downloaded so far: " + Math.Round(downloadedMB, 2) + " MB";

            Component.Message = "Downloading";
            Progress = -1.0;
          }

          Rhino.RhinoApp.Wait();
          System.Threading.Thread.Sleep(300);
        }

        string output = process.StandardOutput.ReadToEnd();
        string error = process.StandardError.ReadToEnd();

        if (process.ExitCode != 0)
        {
          Status =
            "Download failed.\n" +
            "Exit code: " + process.ExitCode + "\n" +
            "Error: " + error + "\n\n" +
            "Test manually by opening Command Prompt and running:\n" +
            "curl.exe -L --http1.1 \"" + modelUrl + "\" -o \"" + tempPath + "\"";

          FilePath = null;
          Progress = 0.0;
          Component.Message = "Error";
          return;
        }
      }

      FileInfo downloadedFile = new FileInfo(tempPath);

      if (!downloadedFile.Exists || downloadedFile.Length == 0)
      {
        if (File.Exists(tempPath))
        {
          File.Delete(tempPath);
        }

        Status = "Download failed: downloaded file is empty.";
        FilePath = null;
        Progress = 0.0;
        Component.Message = "Error";
        return;
      }

      // Optional weak validation: Hugging Face error pages are usually tiny HTML files.
      // A real ONNX model should not start with '<'.
      using (FileStream fs = new FileStream(tempPath, FileMode.Open, FileAccess.Read))
      {
        if (fs.Length > 0)
        {
          int firstByte = fs.ReadByte();

          if (firstByte == 60) // '<'
          {
            fs.Close();

            if (File.Exists(tempPath))
            {
              File.Delete(tempPath);
            }

            Status =
              "Download failed: the downloaded file looks like an HTML error page, not an ONNX model.\n" +
              "Please check whether the Hugging Face file is public and accessible:\n" +
              modelUrl;

            FilePath = null;
            Progress = 0.0;
            Component.Message = "Error";
            return;
          }
        }
      }

      if (File.Exists(destinationPath))
      {
        File.Delete(destinationPath);
      }

      File.Move(tempPath, destinationPath);

      FileInfo finalFile = new FileInfo(destinationPath);

      Status =
        "Model downloaded successfully.\n" +
        "Path: " + destinationPath + "\n" +
        "Size: " + Math.Round(finalFile.Length / 1024.0 / 1024.0, 2) + " MB";

      FilePath = destinationPath;
      Progress = 100.0;
      Component.Message = "Done";
    }
    catch (Exception ex)
    {
      Status =
        "Download failed.\n" +
        "Error: " + ex.Message;

      FilePath = null;
      Progress = 0.0;
      Component.Message = "Error";
    }
  }
}
# ---------- end yel_1_0 ----------

# ---- group: model selection
list_2 = ValueList({"GAN": 0, "GAN with TKE": 1, "GAN with TKE & Roof": 2}, selected="GAN with TKE & Roof")

# ----
# How to?
# 
# -Please downlaod the ML models first (GAN and FNO).
#  Then assign them in the "File Path" components, respectively.
# 
# -Connect your input geometry to "Builidngs"
# 
# -Define wind speed/direction (optional).
# 
# -Define legend (optional).
select = SelectTemplate()

# ---- group: GAN_with_tke_roof
path_2 = FilePath("C:\Users\ilker\Desktop\Conditional_Transformer\Pix2PixHD_Model\pix2pixhd_uk_roof_generator.onnx")

# ----
panel = Panel("""0
0
1""")
branch_2 = TreeBranch(Tree=simplify(graft(panel)), Path=simplify(list_2), MaintainPaths=False)
list_3 = ValueList({"Velocity": 0, "Turbulent Kinetic Energy": 1}, selected="Velocity")

# ---- group: Terrain- Do not change / TERRAIN
srf = Surface(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)

# ---- group: wind direction
list_4 = ValueList({"North": 0, "Northeast": 45, "East": 90, "Southeast": 135, "South": 180, "Southwest": 225, "West": 270, "Northwest": 315}, selected="South")

# ---- group: Terrain- Do not change
move = Move(Geometry=srf, Motion=Vector(0, 0, 1.8))  # -> Geometry, Transform
brep2grid = BrepToGridPoints(Geometry=move.Geometry, Spacing="2", Run=True)  # -> Points, Status

# ---- group: Buildings
brep_4 = Brep(branch)

# ---- group: Wind Speed
panel_2 = Panel("5")

# ---- group: Legend Settings
list_5 = ValueList({"Jet": "jet", "Turbo": "turbo", "Viridis": "viridis", "Magma": "magma", "Plasma": "plasma", "Inferno": "inferno", "Coolwarm": "coolwarm", "Pastel": "pastel", "Gray": "gray"}, selected="Coolwarm")
dom = ConstructDomain(DomainStart=0, DomainEnd=panel_2)

# ----
preview = CustomPreview(Geometry=brep_4, Material=ColourSwatch(SwatchColor=RGB(204, 204, 204)))
entwine_2 = Entwine(Branch00=dom, FlattenInputs=True)  # -> simplify(Result)
swatch = ColourSwatch(SwatchColor=RGB(255, 255, 255))
branch_3 = TreeBranch(Tree=entwine_2, Path=list_3, MaintainPaths=True)
compass = WindCompass(DirectionIndex=list_4, Radius=420, BasePoint=Point(0, 0, 0), Color=swatch, ArrowScale=0.5)  # -> Circle, Arrow
Y = UnitY(Factor=-100)
Y_2 = UnitY(Factor=-50)
concat = Concatenate(
    FragmentA="Incoming wind direction & speed: ",
    FragmentB=compass.Arrow,
    FragmentC=", ",
    FragmentD=panel_2,
    FragmentE=" m/s")

esen_1_0 = CSharpScript(Run=True, Force=False, HF_Token=path)  # -> Status, FilePath, Progress; inputs Run: Boolean, Force: Boolean, HF_Token: String
# ---------- esen_1_0: C# ----------
// Grasshopper Script Instance
#region Usings
using System;
using System.IO;
using System.Diagnostics;
using System.Runtime.InteropServices;

using Rhino;
using Rhino.Geometry;

using Grasshopper;
using Grasshopper.Kernel;
using Grasshopper.Kernel.Data;
using Grasshopper.Kernel.Types;
#endregion

public class Script_Instance : GH_ScriptInstance
{
  private void RunScript(
		bool Run,
		bool Force,
		string HF_Token,
		ref object Status,
		ref object FilePath,
		ref object Progress)
  {
    string modelUrl = "https://huggingface.co/SustainableUrbanSystemsLab/Esen-1.0/resolve/main/Esen1-0.onnx";
    string modelFileName = "Esen1-0.onnx";

    long expectedBytes = 186700128;
    long expectedMinBytes = 180000000;

    Progress = 0.0;

    try
    {
      if (!Run)
      {
        Status = "Set Run to True.";
        FilePath = null;
        Progress = 0.0;
        Component.Message = "Idle";
        return;
      }

      // ------------------------------------------------------------
      // 1. HF_Token is mandatory.
      // It can be:
      // - actual token: hf_xxxxxxxxx
      // - filepath to a .txt file containing the token
      // ------------------------------------------------------------

      if (string.IsNullOrWhiteSpace(HF_Token))
      {
        Status =
          "Access denied.\n\n" +
          "HF_Token input is empty.\n" +
          "Esen is private, so the component will not use the cached model or download the model without a valid token.";

        FilePath = null;
        Progress = 0.0;
        Component.Message = "No Token";
        return;
      }

      string tokenInput = HF_Token.Trim().Trim('"');
      string hfToken = "";

      if (File.Exists(tokenInput))
      {
        hfToken = File.ReadAllText(tokenInput).Trim();

        if (string.IsNullOrWhiteSpace(hfToken))
        {
          Status =
            "Access denied.\n\n" +
            "HF_Token points to a file, but the file is empty.\n\n" +
            "Token file:\n" +
            tokenInput;

          FilePath = null;
          Progress = 0.0;
          Component.Message = "Empty Token";
          return;
        }
      }
      else
      {
        hfToken = tokenInput;
      }

      if (!hfToken.StartsWith("hf_"))
      {
        Status =
          "Access denied.\n\n" +
          "HF_Token is not valid.\n" +
          "It must be either:\n" +
          "1. A Hugging Face token starting with hf_\n" +
          "or\n" +
          "2. A valid filepath to a text file containing a token starting with hf_.";

        FilePath = null;
        Progress = 0.0;
        Component.Message = "Bad Token";
        return;
      }

      // ------------------------------------------------------------
      // 2. Locate local model cache path
      // ------------------------------------------------------------

      string userFolder = Environment.GetFolderPath(Environment.SpecialFolder.UserProfile);

      if (string.IsNullOrWhiteSpace(userFolder) || !Directory.Exists(userFolder))
      {
        Status = "Could not locate the user home folder.";
        FilePath = null;
        Progress = 0.0;
        Component.Message = "Error";
        return;
      }

      string modelFolder = Path.Combine(userFolder, "SUS_LAB");

      if (!Directory.Exists(modelFolder))
      {
        Directory.CreateDirectory(modelFolder);
      }

      string destinationPath = Path.Combine(modelFolder, modelFileName);
      string tempPath = destinationPath + ".download";

      FilePath = destinationPath;

      // ------------------------------------------------------------
      // 3. Determine curl path
      // ------------------------------------------------------------

      bool isWindows = RuntimeInformation.IsOSPlatform(OSPlatform.Windows);
      bool isMac = RuntimeInformation.IsOSPlatform(OSPlatform.OSX);

      string curlPath = "";

      if (isWindows)
      {
        curlPath = "curl.exe";
      }
      else if (isMac)
      {
        curlPath = "/usr/bin/curl";
      }
      else
      {
        Status = "Unsupported operating system. This script currently supports Windows and macOS.";
        FilePath = null;
        Progress = 0.0;
        Component.Message = "Error";
        return;
      }

      // ------------------------------------------------------------
      // 4. Validate token BEFORE using cached model
      // This makes HF_Token act like a pass code.
      // If token is wrong, cached model is not returned.
      // ------------------------------------------------------------

      Component.Message = "Checking Token";
      Status = "Validating Hugging Face token...";

      ProcessStartInfo validatePsi = new ProcessStartInfo();
      validatePsi.FileName = curlPath;

      // We request only byte 0 to avoid downloading the model.
      // If the private repo token is invalid, Hugging Face should return an HTTP error.
      validatePsi.Arguments =
        "-L --fail --show-error --http1.1 " +
        "--connect-timeout 20 " +
        "-A \"Grasshopper-SUSLAB-Token-Validator\" " +
        "-H \"Authorization: Bearer " + hfToken + "\" " +
        "-r 0-0 " +
        "\"" + modelUrl + "\" " +
        "-o " +
        "\"" + Path.Combine(modelFolder, "token_check.tmp") + "\"";

      validatePsi.UseShellExecute = false;
      validatePsi.CreateNoWindow = true;
      validatePsi.RedirectStandardOutput = true;
      validatePsi.RedirectStandardError = true;

      string tokenCheckTemp = Path.Combine(modelFolder, "token_check.tmp");

      if (File.Exists(tokenCheckTemp))
      {
        File.Delete(tokenCheckTemp);
      }

      using (Process validateProcess = new Process())
      {
        validateProcess.StartInfo = validatePsi;
        validateProcess.Start();
        validateProcess.WaitForExit();

        string validateOutput = validateProcess.StandardOutput.ReadToEnd();
        string validateError = validateProcess.StandardError.ReadToEnd();

        if (File.Exists(tokenCheckTemp))
        {
          File.Delete(tokenCheckTemp);
        }

        if (validateProcess.ExitCode != 0)
{
  bool deletedCache = false;

  try
  {
    if (File.Exists(destinationPath))
    {
      File.Delete(destinationPath);
      deletedCache = true;
    }

    if (File.Exists(tempPath))
    {
      File.Delete(tempPath);
    }
  }
  catch (Exception deleteEx)
  {
    Status =
      "Access denied.\n\n" +
      "HF_Token is missing, wrong, expired, or does not have Read access to:\n" +
      "SustainableUrbanSystemsLab/Esen-1.0\n\n" +
      "Tried to delete cached model, but deletion failed.\n\n" +
      "Cache path:\n" +
      destinationPath + "\n\n" +
      "Delete error:\n" +
      deleteEx.Message + "\n\n" +
      "Curl error:\n" +
      validateError;

    FilePath = null;
    Progress = 0.0;
    Component.Message = "Denied";
    return;
  }

  Status =
    "Access denied.\n\n" +
    "HF_Token is missing, wrong, expired, or does not have Read access to:\n" +
    "SustainableUrbanSystemsLab/Esen-1.0\n\n" +
    (deletedCache
      ? "Cached model was deleted because the token is invalid.\n\n"
      : "No cached model was found to delete.\n\n") +
    "Curl error:\n" +
    validateError;

  FilePath = null;
  Progress = 0.0;
  Component.Message = "Denied";
  return;
}
      }

      // ------------------------------------------------------------
      // 5. Only after token validation, allow cache use
      // ------------------------------------------------------------

      if (File.Exists(destinationPath) && !Force)
      {
        FileInfo existingFile = new FileInfo(destinationPath);

        if (existingFile.Length >= expectedMinBytes)
        {
          Status =
            "Access granted.\n" +
            "Valid HF_Token confirmed.\n\n" +
            "Using cached model file.\n" +
            "Path: " + destinationPath + "\n" +
            "Size: " + Math.Round(existingFile.Length / 1024.0 / 1024.0, 2) + " MB\n\n" +
            "Set Force to True to re-download and replace it.";

          Progress = 100.0;
          Component.Message = "Cached";
          FilePath = destinationPath;
          return;
        }

        File.Delete(destinationPath);
      }

      // ------------------------------------------------------------
      // 6. Download model
      // ------------------------------------------------------------

      if (File.Exists(tempPath))
      {
        File.Delete(tempPath);
      }

      Component.Message = "Downloading";
      Status = "Access granted. Downloading private Esen model...";

      ProcessStartInfo psi = new ProcessStartInfo();
      psi.FileName = curlPath;

      psi.Arguments =
        "-L --fail --show-error --http1.1 " +
        "--retry 3 --retry-delay 2 --connect-timeout 30 " +
        "-A \"Grasshopper-SUSLAB-Model-Downloader\" " +
        "-H \"Authorization: Bearer " + hfToken + "\" " +
        "\"" + modelUrl + "\" " +
        "-o " +
        "\"" + tempPath + "\"";

      psi.UseShellExecute = false;
      psi.CreateNoWindow = true;
      psi.RedirectStandardOutput = true;
      psi.RedirectStandardError = true;

      using (Process process = new Process())
      {
        process.StartInfo = psi;
        process.Start();

        while (!process.HasExited)
        {
          if (File.Exists(tempPath))
          {
            FileInfo partialFile = new FileInfo(tempPath);
            double downloadedMB = partialFile.Length / 1024.0 / 1024.0;

            Status =
              "Downloading model...\n" +
              "Downloaded so far: " + Math.Round(downloadedMB, 2) + " MB\n" +
              "Expected size: about 178 MB\n" +
              "Temporary file: " + tempPath;

            Progress = Math.Min(99.0, partialFile.Length * 100.0 / expectedBytes);
            Component.Message = "Downloading";
          }

          Rhino.RhinoApp.Wait();
          System.Threading.Thread.Sleep(300);
        }

        string output = process.StandardOutput.ReadToEnd();
        string error = process.StandardError.ReadToEnd();

        if (process.ExitCode != 0)
        {
          Status =
            "Download failed.\n" +
            "Exit code: " + process.ExitCode + "\n" +
            "Error: " + error + "\n\n" +
            "The token passed validation earlier, but the full file download failed.";

          FilePath = null;
          Progress = 0.0;
          Component.Message = "Error";
          return;
        }
      }

      // ------------------------------------------------------------
      // 7. Validate downloaded file
      // ------------------------------------------------------------

      FileInfo downloadedFile = new FileInfo(tempPath);

      if (!downloadedFile.Exists || downloadedFile.Length == 0)
      {
        if (File.Exists(tempPath)) File.Delete(tempPath);

        Status = "Download failed: downloaded file is empty.";
        FilePath = null;
        Progress = 0.0;
        Component.Message = "Error";
        return;
      }

      string firstText = "";

      using (FileStream fs = new FileStream(tempPath, FileMode.Open, FileAccess.Read))
      using (StreamReader reader = new StreamReader(fs))
      {
        char[] buffer = new char[256];
        int read = reader.Read(buffer, 0, buffer.Length);
        firstText = new string(buffer, 0, read);
      }

      if (firstText.StartsWith("<"))
      {
        if (File.Exists(tempPath)) File.Delete(tempPath);

        Status =
          "Download failed: Hugging Face returned HTML instead of the ONNX model.\n" +
          "This usually means authentication or URL resolution failed.";

        FilePath = null;
        Progress = 0.0;
        Component.Message = "HTML Error";
        return;
      }

      if (firstText.StartsWith("version https://git-lfs.github.com/spec/v1"))
      {
        if (File.Exists(tempPath)) File.Delete(tempPath);

        Status =
          "Download failed: downloaded Git LFS pointer instead of the real ONNX model.\n" +
          "Check that the token has Read access to the private Esen repo.";

        FilePath = null;
        Progress = 0.0;
        Component.Message = "LFS Pointer";
        return;
      }

      if (downloadedFile.Length < expectedMinBytes)
      {
        double gotMB = downloadedFile.Length / 1024.0 / 1024.0;

        if (File.Exists(tempPath)) File.Delete(tempPath);

        Status =
          "Download failed: file is too small.\n" +
          "Expected around 178 MB, but got " +
          Math.Round(gotMB, 2) + " MB.\n\n" +
          "This usually means authentication failed or an incomplete file was downloaded.";

        FilePath = null;
        Progress = 0.0;
        Component.Message = "Too Small";
        return;
      }

      // ------------------------------------------------------------
      // 8. Replace cached model only after successful download
      // ------------------------------------------------------------

      if (File.Exists(destinationPath))
      {
        File.Delete(destinationPath);
      }

      File.Move(tempPath, destinationPath);

      FileInfo finalFile = new FileInfo(destinationPath);

      Status =
        "Model downloaded successfully.\n" +
        "Access granted with valid HF_Token.\n\n" +
        "Path: " + destinationPath + "\n" +
        "Size: " + Math.Round(finalFile.Length / 1024.0 / 1024.0, 2) + " MB";

      FilePath = destinationPath;
      Progress = 100.0;
      Component.Message = "Done";
    }
    catch (Exception ex)
    {
      Status =
        "Operation failed.\n" +
        "Error: " + ex.Message;

      FilePath = null;
      Progress = 0.0;
      Component.Message = "Error";
    }
  }
}
# ---------- end esen_1_0 ----------
poyraz_1_0 = CSharpScript(Run=True, Force=False, HF_Token=path)  # -> Status, FilePath, Progress; inputs Run: Boolean, Force: Boolean, HF_Token: String
# ---------- poyraz_1_0: C# ----------
// Grasshopper Script Instance
#region Usings
using System;
using System.IO;
using System.Diagnostics;
using System.Runtime.InteropServices;

using Rhino;
using Rhino.Geometry;

using Grasshopper;
using Grasshopper.Kernel;
using Grasshopper.Kernel.Data;
using Grasshopper.Kernel.Types;
#endregion

public class Script_Instance : GH_ScriptInstance
{
  private void RunScript(
		bool Run,
		bool Force,
		string HF_Token,
		ref object Status,
		ref object FilePath,
		ref object Progress)
  {
    string modelUrl = "https://huggingface.co/SustainableUrbanSystemsLab/Poyraz/resolve/main/Poyraz1-0.onnx";
    string modelFileName = "Poyraz1-0.onnx";

    long expectedBytes = 186700128;
    long expectedMinBytes = 180000000;

    Progress = 0.0;

    try
    {
      if (!Run)
      {
        Status = "Set Run to True.";
        FilePath = null;
        Progress = 0.0;
        Component.Message = "Idle";
        return;
      }

      // ------------------------------------------------------------
      // 1. HF_Token is mandatory.
      // It can be:
      // - actual token: hf_xxxxxxxxx
      // - filepath to a .txt file containing the token
      // ------------------------------------------------------------

      if (string.IsNullOrWhiteSpace(HF_Token))
      {
        Status =
          "Access denied.\n\n" +
          "HF_Token input is empty.\n" +
          "Esen is private, so the component will not use the cached model or download the model without a valid token.";

        FilePath = null;
        Progress = 0.0;
        Component.Message = "No Token";
        return;
      }

      string tokenInput = HF_Token.Trim().Trim('"');
      string hfToken = "";

      if (File.Exists(tokenInput))
      {
        hfToken = File.ReadAllText(tokenInput).Trim();

        if (string.IsNullOrWhiteSpace(hfToken))
        {
          Status =
            "Access denied.\n\n" +
            "HF_Token points to a file, but the file is empty.\n\n" +
            "Token file:\n" +
            tokenInput;

          FilePath = null;
          Progress = 0.0;
          Component.Message = "Empty Token";
          return;
        }
      }
      else
      {
        hfToken = tokenInput;
      }

      if (!hfToken.StartsWith("hf_"))
      {
        Status =
          "Access denied.\n\n" +
          "HF_Token is not valid.\n" +
          "It must be either:\n" +
          "1. A Hugging Face token starting with hf_\n" +
          "or\n" +
          "2. A valid filepath to a text file containing a token starting with hf_.";

        FilePath = null;
        Progress = 0.0;
        Component.Message = "Bad Token";
        return;
      }

      // ------------------------------------------------------------
      // 2. Locate local model cache path
      // ------------------------------------------------------------

      string userFolder = Environment.GetFolderPath(Environment.SpecialFolder.UserProfile);

      if (string.IsNullOrWhiteSpace(userFolder) || !Directory.Exists(userFolder))
      {
        Status = "Could not locate the user home folder.";
        FilePath = null;
        Progress = 0.0;
        Component.Message = "Error";
        return;
      }

      string modelFolder = Path.Combine(userFolder, "SUS_LAB");

      if (!Directory.Exists(modelFolder))
      {
        Directory.CreateDirectory(modelFolder);
      }

      string destinationPath = Path.Combine(modelFolder, modelFileName);
      string tempPath = destinationPath + ".download";

      FilePath = destinationPath;

      // ------------------------------------------------------------
      // 3. Determine curl path
      // ------------------------------------------------------------

      bool isWindows = RuntimeInformation.IsOSPlatform(OSPlatform.Windows);
      bool isMac = RuntimeInformation.IsOSPlatform(OSPlatform.OSX);

      string curlPath = "";

      if (isWindows)
      {
        curlPath = "curl.exe";
      }
      else if (isMac)
      {
        curlPath = "/usr/bin/curl";
      }
      else
      {
        Status = "Unsupported operating system. This script currently supports Windows and macOS.";
        FilePath = null;
        Progress = 0.0;
        Component.Message = "Error";
        return;
      }

      // ------------------------------------------------------------
      // 4. Validate token BEFORE using cached model
      // This makes HF_Token act like a pass code.
      // If token is wrong, cached model is not returned.
      // ------------------------------------------------------------

      Component.Message = "Checking Token";
      Status = "Validating Hugging Face token...";

      ProcessStartInfo validatePsi = new ProcessStartInfo();
      validatePsi.FileName = curlPath;

      // We request only byte 0 to avoid downloading the model.
      // If the private repo token is invalid, Hugging Face should return an HTTP error.
      validatePsi.Arguments =
        "-L --fail --show-error --http1.1 " +
        "--connect-timeout 20 " +
        "-A \"Grasshopper-SUSLAB-Token-Validator\" " +
        "-H \"Authorization: Bearer " + hfToken + "\" " +
        "-r 0-0 " +
        "\"" + modelUrl + "\" " +
        "-o " +
        "\"" + Path.Combine(modelFolder, "token_check.tmp") + "\"";

      validatePsi.UseShellExecute = false;
      validatePsi.CreateNoWindow = true;
      validatePsi.RedirectStandardOutput = true;
      validatePsi.RedirectStandardError = true;

      string tokenCheckTemp = Path.Combine(modelFolder, "token_check.tmp");

      if (File.Exists(tokenCheckTemp))
      {
        File.Delete(tokenCheckTemp);
      }

      using (Process validateProcess = new Process())
      {
        validateProcess.StartInfo = validatePsi;
        validateProcess.Start();
        validateProcess.WaitForExit();

        string validateOutput = validateProcess.StandardOutput.ReadToEnd();
        string validateError = validateProcess.StandardError.ReadToEnd();

        if (File.Exists(tokenCheckTemp))
        {
          File.Delete(tokenCheckTemp);
        }

        if (validateProcess.ExitCode != 0)
{
  bool deletedCache = false;

  try
  {
    if (File.Exists(destinationPath))
    {
      File.Delete(destinationPath);
      deletedCache = true;
    }

    if (File.Exists(tempPath))
    {
      File.Delete(tempPath);
    }
  }
  catch (Exception deleteEx)
  {
    Status =
      "Access denied.\n\n" +
      "HF_Token is missing, wrong, expired, or does not have Read access to:\n" +
      "SustainableUrbanSystemsLab/Esen-1.0\n\n" +
      "Tried to delete cached model, but deletion failed.\n\n" +
      "Cache path:\n" +
      destinationPath + "\n\n" +
      "Delete error:\n" +
      deleteEx.Message + "\n\n" +
      "Curl error:\n" +
      validateError;

    FilePath = null;
    Progress = 0.0;
    Component.Message = "Denied";
    return;
  }

  Status =
    "Access denied.\n\n" +
    "HF_Token is missing, wrong, expired, or does not have Read access to:\n" +
    "SustainableUrbanSystemsLab/Esen-1.0\n\n" +
    (deletedCache
      ? "Cached model was deleted because the token is invalid.\n\n"
      : "No cached model was found to delete.\n\n") +
    "Curl error:\n" +
    validateError;

  FilePath = null;
  Progress = 0.0;
  Component.Message = "Denied";
  return;
}
      }

      // ------------------------------------------------------------
      // 5. Only after token validation, allow cache use
      // ------------------------------------------------------------

      if (File.Exists(destinationPath) && !Force)
      {
        FileInfo existingFile = new FileInfo(destinationPath);

        if (existingFile.Length >= expectedMinBytes)
        {
          Status =
            "Access granted.\n" +
            "Valid HF_Token confirmed.\n\n" +
            "Using cached model file.\n" +
            "Path: " + destinationPath + "\n" +
            "Size: " + Math.Round(existingFile.Length / 1024.0 / 1024.0, 2) + " MB\n\n" +
            "Set Force to True to re-download and replace it.";

          Progress = 100.0;
          Component.Message = "Cached";
          FilePath = destinationPath;
          return;
        }

        File.Delete(destinationPath);
      }

      // ------------------------------------------------------------
      // 6. Download model
      // ------------------------------------------------------------

      if (File.Exists(tempPath))
      {
        File.Delete(tempPath);
      }

      Component.Message = "Downloading";
      Status = "Access granted. Downloading private Esen model...";

      ProcessStartInfo psi = new ProcessStartInfo();
      psi.FileName = curlPath;

      psi.Arguments =
        "-L --fail --show-error --http1.1 " +
        "--retry 3 --retry-delay 2 --connect-timeout 30 " +
        "-A \"Grasshopper-SUSLAB-Model-Downloader\" " +
        "-H \"Authorization: Bearer " + hfToken + "\" " +
        "\"" + modelUrl + "\" " +
        "-o " +
        "\"" + tempPath + "\"";

      psi.UseShellExecute = false;
      psi.CreateNoWindow = true;
      psi.RedirectStandardOutput = true;
      psi.RedirectStandardError = true;

      using (Process process = new Process())
      {
        process.StartInfo = psi;
        process.Start();

        while (!process.HasExited)
        {
          if (File.Exists(tempPath))
          {
            FileInfo partialFile = new FileInfo(tempPath);
            double downloadedMB = partialFile.Length / 1024.0 / 1024.0;

            Status =
              "Downloading model...\n" +
              "Downloaded so far: " + Math.Round(downloadedMB, 2) + " MB\n" +
              "Expected size: about 178 MB\n" +
              "Temporary file: " + tempPath;

            Progress = Math.Min(99.0, partialFile.Length * 100.0 / expectedBytes);
            Component.Message = "Downloading";
          }

          Rhino.RhinoApp.Wait();
          System.Threading.Thread.Sleep(300);
        }

        string output = process.StandardOutput.ReadToEnd();
        string error = process.StandardError.ReadToEnd();

        if (process.ExitCode != 0)
        {
          Status =
            "Download failed.\n" +
            "Exit code: " + process.ExitCode + "\n" +
            "Error: " + error + "\n\n" +
            "The token passed validation earlier, but the full file download failed.";

          FilePath = null;
          Progress = 0.0;
          Component.Message = "Error";
          return;
        }
      }

      // ------------------------------------------------------------
      // 7. Validate downloaded file
      // ------------------------------------------------------------

      FileInfo downloadedFile = new FileInfo(tempPath);

      if (!downloadedFile.Exists || downloadedFile.Length == 0)
      {
        if (File.Exists(tempPath)) File.Delete(tempPath);

        Status = "Download failed: downloaded file is empty.";
        FilePath = null;
        Progress = 0.0;
        Component.Message = "Error";
        return;
      }

      string firstText = "";

      using (FileStream fs = new FileStream(tempPath, FileMode.Open, FileAccess.Read))
      using (StreamReader reader = new StreamReader(fs))
      {
        char[] buffer = new char[256];
        int read = reader.Read(buffer, 0, buffer.Length);
        firstText = new string(buffer, 0, read);
      }

      if (firstText.StartsWith("<"))
      {
        if (File.Exists(tempPath)) File.Delete(tempPath);

        Status =
          "Download failed: Hugging Face returned HTML instead of the ONNX model.\n" +
          "This usually means authentication or URL resolution failed.";

        FilePath = null;
        Progress = 0.0;
        Component.Message = "HTML Error";
        return;
      }

      if (firstText.StartsWith("version https://git-lfs.github.com/spec/v1"))
      {
        if (File.Exists(tempPath)) File.Delete(tempPath);

        Status =
          "Download failed: downloaded Git LFS pointer instead of the real ONNX model.\n" +
          "Check that the token has Read access to the private Esen repo.";

        FilePath = null;
        Progress = 0.0;
        Component.Message = "LFS Pointer";
        return;
      }

      if (downloadedFile.Length < expectedMinBytes)
      {
        double gotMB = downloadedFile.Length / 1024.0 / 1024.0;

        if (File.Exists(tempPath)) File.Delete(tempPath);

        Status =
          "Download failed: file is too small.\n" +
          "Expected around 178 MB, but got " +
          Math.Round(gotMB, 2) + " MB.\n\n" +
          "This usually means authentication failed or an incomplete file was downloaded.";

        FilePath = null;
        Progress = 0.0;
        Component.Message = "Too Small";
        return;
      }

      // ------------------------------------------------------------
      // 8. Replace cached model only after successful download
      // ------------------------------------------------------------

      if (File.Exists(destinationPath))
      {
        File.Delete(destinationPath);
      }

      File.Move(tempPath, destinationPath);

      FileInfo finalFile = new FileInfo(destinationPath);

      Status =
        "Model downloaded successfully.\n" +
        "Access granted with valid HF_Token.\n\n" +
        "Path: " + destinationPath + "\n" +
        "Size: " + Math.Round(finalFile.Length / 1024.0 / 1024.0, 2) + " MB";

      FilePath = destinationPath;
      Progress = 100.0;
      Component.Message = "Done";
    }
    catch (Exception ex)
    {
      Status =
        "Operation failed.\n" +
        "Error: " + ex.Message;

      FilePath = null;
      Progress = 0.0;
      Component.Message = "Error";
    }
  }
}
# ---------- end poyraz_1_0 ----------
entwine_3 = Entwine(Branch00=yel_1_0.Status, Branch01=esen_1_0.Status, Branch02=poyraz_1_0.Status, FlattenInputs=True)  # -> simplify(Result)
branch_4 = TreeBranch(Tree=entwine_3, Path=list_2, MaintainPaths=False)
panel_3 = Panel(branch_4)

# ---- group: GAN_with tke
path_3 = FilePath(esen_1_0.FilePath)

# ----
entwine_4 = Entwine(Branch00=yel_1_0.FilePath, Branch01=path_3, Branch02=path_2, FlattenInputs=True)  # -> simplify(Result)
branch_5 = TreeBranch(Tree=entwine_4, Path=list_2, MaintainPaths=False)

windpredict = WindPredictor(
    Points=brep2grid.Points,
    Buildings=brep_4,
    ONNXPath=branch_5,
    U_ref=panel_2,
    Z_ref=10,
    Pedestrian_level=1.8,
    Wind_dir=list_4,
    GPU=True,
    FilterMargin=100,
    Palette=list_5,
    LegendDomain=branch_3,
    Interpolate=True,
    ShowTKE=list_3,
    ShowRoof=branch_2)  # -> X, Y, WindSpeed, GridMesh, LegendMesh, LegendPoints, LegendValues, TurbulentKineticEnergy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
entwine_5 = Entwine(Branch00=windpredict.WindSpeed, Branch01=windpredict.TurbulentKineticEnergy, FlattenInputs=True)  # -> simplify(Result)
mesh = Mesh(windpredict.GridMesh)
mesh_2 = Mesh(windpredict.LegendMesh)
tag = TextTag3D(Location=windpredict.LegendPoints, Text=windpredict.LegendValues, Size=14, Colour=swatch, Justification=5)
area = Area(Geometry=mesh_2)  # -> Area, Centroid
branch_6 = TreeBranch(Tree=entwine_5, Path=list_3, MaintainPaths=True)
bnd = Bounds(Numbers=branch_6)

# ---- group: Wind speed range
panel_4 = Panel(bnd)

# ----
move_2 = Move(Geometry=area.Centroid, Motion=Y)  # -> Geometry, Transform
move_3 = Move(Geometry=move_2.Geometry, Motion=Y_2)  # -> Geometry, Transform
concat_2 = Concatenate(FragmentA="Min - Max: ", FragmentB=panel_4)
tag_2 = TextTag3D(Location=move_2.Geometry, Text=concat_2, Size=16, Colour=swatch, Justification=5)
tag_3 = TextTag3D(Location=move_3.Geometry, Text=concat, Size=16, Colour=swatch, Justification=5)
