# Grasshopper definition ClimateCharts.ghx (Grasshopper 1.0.8)
# plug-ins: Outdoor, Eddy3D, Eddy3D-Radiance

weather = DownloadWeather(Station="Istanbul")  # -> EPWFile, Logs, Stations, Station, ExtraFiles, SiteLatitude, SiteLongitude
weather_2 = Weather(EPWFilePath=weather.EPWFile)
pt = ConstructPoint(XCoordinate=0, YCoordinate=expr("x*-4", "100"), ZCoordinate=0)
sunpath = SunPath(Weather=weather_2, Latitude=0, Longitude=0, TimeZone=0, Center=Point(0, 0, 0), Radius="100", North=0)  # -> Arcs, Analemmas, Suns, Compass, Report
compass = WindCompass(WindDirection=0, Radius="100", BasePoint=Point(0, 0, 0), Color=RGB(105, 105, 105), ArrowScale=1, Weather=weather_2)  # -> Vector, DirectionName
climatechart = MonthlyClimateChart(Weather=weather_2, BasePoint=pt, Width=expr("x*5", "100"), Height=expr("x*2", "100"))  # -> Months, TemperatureMinimum, TemperatureMean, TemperatureMaximum, HumidityMinimum, HumidityMean, HumidityMaximum
