# Grasshopper definition Solar_radiation.ghx (Grasshopper 1.0.8)
# plug-ins: Outdoor, Eddy3D, Eddy3D-Radiance

# ---- group: Ground Surface
brep = Brep(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)

# ----
number_slider = Slider(1, range=0..1)
brepgrid = BrepGridPoints(Geometry=brep, Spacing=number_slider)  # -> Points, Vectors, Mesh, Status
bbox = BoundingBox(Content=brep, Plane=PlaneXY(0, 0, 0), UnionBox=True)  # -> Box, Box_2
number_slider_2 = Slider(20, range=0..1000)
debrep = DeconstructBrep(Brep=bbox.Box)  # -> Faces, Edges, Vertices
item = ListItem(List=debrep.Vertices, Index=1, Wrap=True)
item_2 = ListItem(List=debrep.Edges, Index=0, Wrap=True)
context = Brep([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])
join = BrepJoin(Breps=context)  # -> Breps, Closed
len = Length(Curve=item_2)
X = UnitX(Factor=expr("x*.2", len))
preview = CustomPreview(Geometry=join.Breps, Material=ColourSwatch(SwatchColor=RGB(255, 255, 255)))
move = Move(Geometry=item, Motion=X)  # -> Geometry, Transform
sky_exposure = SkyExposure(Positions=brepgrid.Points, Context=join.Breps, Offset=0.918)
brepgrid_2 = BrepGridPoints(Geometry=join.Breps, Spacing=number_slider)  # -> Points, Vectors, Mesh, Status

weather = DownloadWeather(Search="istanbul")  # -> EPWFile, Logs, Stations

weather_2 = Weather(EPWFilePath=weather.EPWFile)
sky_exposure_2 = SkyExposure(Positions=brepgrid_2.Points, Context=join.Breps, Offset=0.918)

solarirr = SolarIrradiation(
    Context=join.Breps,
    Points=brepgrid_2.Points,
    Normals=brepgrid_2.Vectors,
    Weather=weather_2,
    Timestep=1,
    SkyView=sky_exposure_2,
    GroundReflectance=0.2,
    Offset=0.01,
    North=0,
    SolarIrradiationInputLayoutVersion=2)  # -> Total, Direct, Diffuse, Reflected, Colors, Report
bnd = Bounds(Numbers=solarirr.Total)
flexlegend = FlexLegend(
    Range=bnd,
    Plane=PlaneXY(0, 0, 0),
    ColorMap="Turbo",
    Points=brepgrid_2.Points,
    Normals=brepgrid_2.Vectors,
    Offset=0.5,
    Values=solarirr.Total,
    MetricType="wind speed",
    FlexLegendInputLayoutVersion=3)  # -> LegendMesh, LegendPoints, LegendValues, FieldMesh, Colors, ResolvedRange

solarirr_2 = SolarIrradiation(
    Context=join.Breps,
    Points=brepgrid.Points,
    Normals=brepgrid.Vectors,
    Weather=weather_2,
    Timestep=1,
    SkyView=sky_exposure,
    GroundReflectance=0.2,
    Offset=0.01,
    North=0,
    SolarIrradiationInputLayoutVersion=2)  # -> Total, Direct, Diffuse, Reflected, Colors, Report
round = Round(Number=solarirr_2.Total)  # -> Nearest, Floor, Ceiling
tag = TextTag(Location=brepgrid.Points, Text=round.Nearest, Colour=ColourSwatch(SwatchColor=RGB(255, 255, 255)))
flexlegend_2 = FlexLegend(
    Range=bnd,
    Plane=PlaneXY(0, 0, 0),
    ColorMap="Turbo",
    Points=brepgrid.Points,
    Normals=brepgrid.Vectors,
    Offset=0.5,
    Values=solarirr_2.Total,
    MetricType="solar radiation",
    FlexLegendInputLayoutVersion=3)  # -> LegendMesh, LegendPoints, LegendValues, FieldMesh, Colors, ResolvedRange

mesh = Mesh(flexlegend.FieldMesh)
