# Grasshopper definition PALM_4U.ghx (Grasshopper 1.0.8)
# plug-ins: Eddy3D-PALM

palm_sample_buildings = ImportedSTL([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])
palm_sample_trees = ImportedSTL([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])
geometry = Geometry(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)
mjoin = MeshJoin(Meshes=palm_sample_buildings)
mjoin_2 = MeshJoin(Meshes=palm_sample_trees)
# Description: Skeleton workflow for PALM-4U, the large-eddy urban microclimate model, ending in pedestrian-level PET maps. PALM Domain sets a 64 x 64 x 48 grid of 2 m cells. Sample STL meshes (three buildings, two tree crowns, all wired to Buildings), a terrain surface and OpenStreetMap land cover from PALM Land Cover (toggle Fetch) feed PALM Case, which writes the static driver and namelist. PALM Settings holds 2 h, a 3 m/s westerly wind and comfort on. PALM Run starts the container, PALM Progress follows it, PALM Results reads the averaged bio_pet field. Needs the PALM container image from Eddy3D Setup.
# PALM-4U — urban microclimate (skeleton)
# 
# 1  Define the grid over your site (lower-left corner at the Rhino origin, y = north).
# 2  Wire terrain, buildings and tree crowns into PALM Static Driver, toggle Write.
# 3  Set wind + duration in PALM Settings, then toggle Run.
# 4  Watch PALM Progress; read PET/UTCI maps in PALM Results.
# 
# Needs the PALM container image — Eddy3D Setup → Urban microclimate (PALM-4U).
palm_domain = PALMDomain(Latitude=52.5, Longitude=13.4, CellSize=2, CellsX=64, CellsY=64, CellsZ=48, Origin=Point(0, 0, 0))  # -> Domain, Boundary, Summary
palm_land_cover = PALMLandCover(Domain=palm_domain.Domain, Fetch=False)  # -> LandCover, Outlines, Report
palm_settings = PALMSettings(
    Duration=2,
    Spinup=0.5,
    OutputInterval=10,
    WindSpeed=3,
    WindDirection=270,
    AirTemperature=20,
    Humidity=0.008,
    DateTime="2023-06-21 12:00:00 +00",
    SliceHeight=2,
    Comfort=True)  # -> Settings, Summary
palm_case = PALMCase(
    Domain=palm_domain.Domain,
    Buildings=[mjoin, mjoin_2],
    Terrain=geometry,
    LandCover=palm_land_cover.LandCover,
    BuildingType="3 — Residential — after 2000",
    VegetationType="3 — Short grass",
    PavementType="1 — Asphalt / concrete mix",
    WaterType="1 — Lake",
    GroundCover="3 — Short grass",
    SoilType="3 — Medium-fine",
    LeafAreaDensity=2,
    Settings=palm_settings.Settings,
    Write=False,
    Clear=False,
    AutoCaseName="swift-salmon-summit-hammer",
    PalmCaseInputLayoutVersion=2,
    PreviewBoundaries=True,
    PreviewDimensions=True,
    PreviewGrid=False,
    PreviewGrid3D=False,
    PreviewSurface=True,
    PreviewWind=True)  # -> Driver, Path, Report, Namelist, DomainBox
palm_run = PALMRun(
    Driver=palm_case.Driver,
    Engine="Container (Docker/Podman)",
    Image="Auto (published image for this machine)",
    Run=False,
    PalmRunInputLayoutVersion=6)  # -> Namelist, Script, Command, Status, CaseFolder
palm_progress = PALMProgress(CaseFolder=palm_run.CaseFolder, Live=True)  # -> Progress, SimulatedTime, Done, Status
palm_results = PALMResults(
    CaseFolder=palm_run.CaseFolder,
    File="Averaged XY (…_av_xy)",
    Variable="bio_pet*_xy",
    Frame=Slider(0, range=0..23),
    Domain=palm_domain.Domain)  # -> Mesh, Values, Variables, Times, Info
