# Grasshopper definition Surrogate_annual_thermal_comfort_analysis.ghx (Grasshopper 1.0.8)
# plug-ins: Outdoor, Eddy3D, Eddy3D-Radiance

# Description: Purpose: UTCI across a circular site for one hour or the whole year, without CFD.
# Fidelity: Screening - machine-learning wind (Yel 2.0); trees count as solid obstructions.
# Method: Wind Predictor for 8 directions, scaled to each Atlanta hour by VAF; MRT Surface, Sensors, View Factors and Solve feed UTCI (Simulation).
# Result: UTCI per sensor on a 4 m grid at 1.8 m, coloured by Thermal Comfort Legend; an Hourly/Annual list picks the hour.
# Needs: Nothing to install; ML Model downloads Yel 2.0 on first use. Runtime: minutes.
# Edit: Buildings, trees, ground, weather file, sensor grid spacing.
select = SelectTemplate()
weather = DownloadWeather(Station="atlanta", ChartMonthFrom=1, ChartMonthTo=12)  # -> EPWFile, Logs, Stations, Station, ExtraFiles, SiteLatitude, SiteLongitude
srf = Surface(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)
number_slider = Slider(3, range=0..10)

# ---- group: Tree - handled as solid obstructions in the wind analysis
mesh = Mesh([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])
preview = CustomPreview(Geometry=mesh, Material=ColourSwatch(SwatchColor=RGBA(147, 168, 145, 152)))

# ---- group: Buildings
context = Brep([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])
preview_2 = CustomPreview(Geometry=context, Material=ColourSwatch(SwatchColor=RGB(255, 255, 255)))

# ----
move = Move(Geometry=srf, Motion="0,0,1.8")  # -> Geometry, Transform

# ---- group: Ground surface
cir = Circle(Plane=PlaneXY(0, 0, 0), Radius=100)
srf_2 = Surface(cir)
brepgrid = BrepGridPoints(Geometry=move.Geometry, Spacing=Slider(4, range=0..10))  # -> Points, Vectors, Mesh, Status

# ----
merge = Merge(Data1=context, Data2=mesh)

# ---- group: EPW extracted values
panel = Panel("1")
calendar = Calendar(Day=7, Hour=8, Month=9)
deweather = DeconstructWeather(Weather=weather.EPWFile, Series="""Dry Bulb Temperature
Relative Humidity
Wind Speed
Wind Direction""")  # -> DryBulbTemperature, RelativeHumidity, WindSpeed, WindDirection

# ---- group: EPW extracted values / hour of the year, index arrangement
subtraction = Subtraction(A=calendar, B=panel)

# ---- group: Terrain (do not change)
cir_2 = Circle(Plane=PlaneXY(0, 0, 0), Radius=504)
Z = UnitZ(Factor=1.8)
srf_3 = Surface(cir_2)
move_2 = Move(Geometry=srf_3, Motion=Z)  # -> Geometry, Transform

# ----
surfsettings = SurfaceSettings(
    Thickness=0.1,
    Conductivity=2.3,
    Density=2400,
    SpecificHeat=840,
    ThermalAbsorptance=0.9,
    SolarAbsorptance=0.7,
    VisibleAbsorptance=0.7)
surfsettings_2 = SurfaceSettings(
    Thickness=0.1,
    Conductivity=2.3,
    Density=2400,
    SpecificHeat=840,
    ThermalAbsorptance=0.9,
    SolarAbsorptance=0.7,
    VisibleAbsorptance=0.7)
tree = TreeSettings(
    Reflectivity=0.2,
    Emissivity=0.95,
    LeafOnTransmittance=0,
    LeafOffTransmittance=0,
    LeafOn=0,
    LeafOff=0,
    Evergreen=False,
    LeafAreaDensity=0,
    AirTemperature=False)
series = Series(Start=0, Step="45", Count="8")
mrt_surface = MRTSurface(Geometry=context, Simulated=True, PatchSize=3, Material=surfsettings_2, LegacyOpaqueTrees=True)  # -> Surface, Mesh
mrt_surface_2 = MRTSurface(Geometry=mesh, Simulated=True, PatchSize=3, Material=tree, LegacyOpaqueTrees=True)  # -> Surface, Mesh
mlmodel = MLModel(Model="Yel 2.0", Run=Toggle(True), MLModelInputLayoutVersion=2)  # -> Status, FilePath, Progress

# ---- group: Surrogate
brepgrid_2 = BrepGridPoints(Geometry=move_2.Geometry, Spacing=2)  # -> Points, Vectors, Mesh, Status
abl = AtmosphericBoundaryLayer(
    WindDirections=series,
    ReferenceHeight=10,
    RoughnessLengthZ0=1,
    GroundHeight=0,
    TurbulentKEK=0.015,
    TurbulentEpsilonΕ=0.135,
    TurbulentOmegaΩ=100,
    TerrainType="Custom (z0 input)",
    InletProfile="Log law (Richards & Hoxey)",
    DisplacementHeight=0,
    AblOutputLayoutVersion=2)  # -> BoundaryConditions, WindVectors
windpredict = WindPredictor(
    Points=brepgrid_2.Points,
    Buildings=merge,
    Model=mlmodel.FilePath,
    BoundaryConditions=abl.BoundaryConditions,
    PedestrianLevel=1.8,
    FilterMargin=100,
    Palette="jet",
    Interpolate="Smooth",
    Field="Velocity",
    Level="Pedestrian Level",
    SelectionPoints=brepgrid.Points,
    Radius=0.75,
    LegendScale=1,
    MeshType="Square",
    Engine="Auto",
    Run=True,
    WindPredictorInputLayoutVersion=2,
    WindPredictorOutputLayoutVersion=2)  # -> Points, Values, GridMesh, LegendMesh, LegendPoints, LegendValues, BoundaryConditions, ValuesRoof

# ----
sensors = MRTSensors(Sensors=brepgrid.Points, Normal=brepgrid.Vectors, Height=0)  # -> Sensors, Points

# ---- group: Surrogate / Wind speed output
mesh_2 = Mesh(windpredict.GridMesh)

# ----
vaf = VelocityAmplificationFactorsVAF(
    BoundaryConditions=abl.BoundaryConditions,
    WindVelocity=windpredict.Values,
    EPW=weather.EPWFile,
    ProbeHeight=1.8,
    Interpolate="True",
    Points=brepgrid.Points,
    Factors="Spatial (per direction)",
    PeakFactor=3.5)  # -> WindSpeed, VelocityAmplificationFactors, AnnualVAF, GustSpeed, SpeedRatios

calendar_2 = Calendar(Day=10, Hour=13, Month=6)

# ---- group: Hourly/Annual
list = ValueList({"Hourly": 0, "Annual": 1}, selected="Annual")

# ----
list_2 = ValueList({"Comfort Bins": 0, "Actual values": 1}, selected="Actual values")
branch = TreeBranch(Tree=Tree({0}: ["comfort bins"], {1}: ["actual values"]), Path=list_2, MaintainPaths=True)

mrt_surface_3 = MRTSurface(Geometry=srf, Simulated=True, PatchSize=3, Material=surfsettings, LegacyOpaqueTrees=True)  # -> Surface, Mesh

merge_2 = Merge(Data1=mrt_surface_3.Surface, Data2=mrt_surface.Surface, Data3=mrt_surface_2.Surface)

vf = MRTViewFactors(
    Surfaces=merge_2,
    Sensors=sensors.Sensors,
    SkyDomeSubdivisions="5 — 3,072 sky patches",
    Fidelity="Fast",
    Engine="Auto",
    Run=Toggle(True))  # -> VFModel, SkyDome, Log
solve = MRTSolve(VFModel=vf.VFModel, EPW=weather.EPWFile, Engine="Native", Compute="Auto", Run=Toggle(True), MrtSolveInputLayoutVersion=2)  # -> Probes, Result, Log

# ---- group: Hourly analysis
utcisim = UTCISimulation(
    MRT=solve.Result,
    WindSpeed=vaf.WindSpeed,
    AirTemperature=deweather.DryBulbTemperature,
    RelativeHumidity=deweather.RelativeHumidity,
    Transpose="Hours × Probes",
    Engine="Auto",
    Run=True,
    UtciInputLayoutVersion=2)  # -> UTCI, ComfortHours, Comfort, Result
entwine = Entwine(Branch00=calendar_2, FlattenInputs=True)  # -> simplify(Result)
branch_2 = TreeBranch(Tree=entwine, Path=list, MaintainPaths=True)
deutci = DeconstructUTCI(Result=utcisim.Result, HOY=branch_2, DeUtciInputLayoutVersion=2, DeUtciOutputLayoutVersion=2)  # -> Mean, Min, Max, ComfortHours, Comfort, UTCI, Points
legend = ThermalComfortLegend(
    Values=deutci.Mean,
    Plane=PlaneXY(0, 0, 0),
    Size=2,
    Mesh=brepgrid.Mesh,
    GroundSurface=srf,
    Offset=5,
    SmoothColors=True,
    CircleRadius=1.5,
    SensorPoints=brepgrid.Points,
    Scale=5,
    Metric="utci",
    ColorScale=branch,
    Statistic="min",
    LegendText="both",
    UtciLegendInputLayoutVersion=2,
    UtciLegendShowValues=True)  # -> Colors, Categories, LegendMesh, LabelPoints, Labels, UTCIMesh, CenteredLabels, Range
mesh_3 = Mesh(legend.UTCIMesh)
mesh_4 = Mesh(legend.LegendMesh)
tag = TextTag3D(Location=legend.LabelPoints, Text=legend.Labels, Size=1, Colour=ColourSwatch(SwatchColor=RGB(0, 0, 0)), Justification=7)

# ----
mjoin = MeshJoin(Meshes=[mesh_3, mesh_4])
