# Grasshopper definition Surrogate_hourly_thermal_comfort_analysis.ghx (Grasshopper 1.0.8)
# plug-ins: Outdoor, Eddy3D, Eddy3D-Radiance

panel = Panel("https://energyplus-weather.s3.amazonaws.com/north_and_central_america_wmo_region_4/USA/GA/USA_GA_Atlanta-Hartsfield-Jackson.Intl.AP.722190_TMY3/USA_GA_Atlanta-Hartsfield-Jackson.Intl.AP.722190_TMY3.epw")
# Description: Hourly UTCI at sensors on a circular patch, with the wind field predicted by machine learning. ML Model downloads Yel 2.0; Wind Predictor evaluates the context Brep for eight directions at 45 degree steps, using a 7 m/s reference wind from the Atmospheric Boundary Layer. Velocity Amplification Factors (VAF), in Annual per hour mode, map predictions onto each Atlanta TMY3 hour. MRT Surface, MRT Sensors, MRT View Factors (192 sky patches, Fast) and a native MRT Solve supply radiant temperature to UTCI (Simulation); Deconstruct UTCI reduces it to statistics. Buildings only, no trees; swap in your own. Screening, not CFD.
cir = Circle(Plane=PlaneXY(0, 0, 0), Radius=60)
context = Brep([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])
srf = Surface(cir)
download_weather = DownloadWeather(Station=panel)  # -> EPWFile, Logs, Stations, Station, ExtraFiles, SiteLatitude, SiteLongitude
brepgrid = BrepGridPoints(Geometry=srf, Spacing=2)  # -> Points, Vectors, Mesh, Status
deweather = DeconstructWeather(Weather=download_weather.EPWFile, Series="""Dry Bulb Temperature
Relative Humidity
Wind Speed
Wind Direction""")  # -> DryBulbTemperature, RelativeHumidity, WindSpeed, WindDirection
cir_2 = Circle(Plane=PlaneXY(0, 0, 0), Radius=504)
Z = UnitZ(Factor=1.8)
srf_2 = Surface(cir_2)
move = Move(Geometry=srf_2, Motion=Z)  # -> Geometry, Transform
mrt_surface = MRTSurface(Geometry=context, Simulated=True, PatchSize=3, LegacyOpaqueTrees=True)  # -> Surface, Mesh
sensors = MRTSensors(Sensors=brepgrid.Points, Normal=Vector(0, 0, 1), Height=1.1)  # -> Sensors, Points
series = Series(Start="0", Step="45", Count="8")
mlmodel = MLModel(Model="Yel 2.0", Run=Toggle(True), MLModelInputLayoutVersion=2)  # -> Status, FilePath, Progress
brepgrid_2 = BrepGridPoints(Geometry=move.Geometry, Spacing=2)  # -> Points, Vectors, Mesh, Status
boolean_toggle = BooleanToggle(True)
abl = AtmosphericBoundaryLayer(
    WindDirections=series,
    WindSpeed="7",
    ReferenceHeight=10,
    RoughnessLengthZ0=1,
    GroundHeight=0,
    TurbulentKEK=0.015,
    TurbulentEpsilonΕ=0.135,
    TurbulentOmegaΩ=100,
    TerrainType="Custom (z0 input)",
    AblOutputLayoutVersion=2)  # -> BoundaryConditions, WindVectors
mrt_view_factors = MRTViewFactors(
    Surfaces=mrt_surface.Surface,
    Sensors=sensors.Sensors,
    SkyDomeSubdivisions="3 — 192 sky patches",
    Fidelity="Fast",
    Run=boolean_toggle)  # -> VFModel, SkyDome, Log
windpredict = WindPredictor(
    Points=brepgrid_2.Points,
    Buildings=context,
    Model=mlmodel.FilePath,
    BoundaryConditions=abl.BoundaryConditions,
    PedestrianLevel=1.8,
    FilterMargin=100,
    Palette="jet",
    Interpolate="Smooth",
    Field="Velocity",
    Level="Pedestrian Level",
    SelectionPoints=brepgrid.Points,
    Radius=0.75,
    LegendScale=1,
    MeshType="Square",
    Run=Toggle(True))  # -> X, Y, Values, GridMesh, LegendMesh, LegendPoints, LegendValues, BoundaryConditions, ValuesRoof
mrt_solve = MRTSolve(VFModel=mrt_view_factors.VFModel, EPW=download_weather.EPWFile, Engine="Native", Run=boolean_toggle)  # -> Probes, Result, Log
construct_point = ConstructPoint(XCoordinate=windpredict.X, YCoordinate=windpredict.Y, ZCoordinate=0)
velocity_amplification_factors_vaf = VelocityAmplificationFactorsVAF(
    BoundaryConditions=abl.BoundaryConditions,
    WindVelocity=windpredict.Values,
    EPW=download_weather.EPWFile,
    ProbeHeight=1.8,
    Interpolate="False",
    Points=construct_point,
    Factors="Annual (per hour)",
    PeakFactor=3.5)  # -> WindSpeed, VelocityAmplificationFactors, AnnualVAF, GustSpeed, SpeedRatios
utci_simulation = UTCISimulation(
    MRT=mrt_solve.Result,
    WindSpeed=velocity_amplification_factors_vaf.WindSpeed,
    AirTemperature=deweather.DryBulbTemperature,
    RelativeHumidity=deweather.RelativeHumidity,
    Transpose="Hours × Probes",
    Run=True)  # -> UTCI, ComfortHours, Comfort, Result
deconstruct_utci = DeconstructUTCI(Result=utci_simulation.Result, DeUtciInputLayoutVersion=2, DeUtciOutputLayoutVersion=2)  # -> Mean, Min, Max, ComfortHours, Comfort, UTCI, Points
