# Grasshopper definition Sunpath.ghx (Grasshopper 1.0.8)
# plug-ins: Outdoor, Eddy3D, Eddy3D-Radiance

# Description: A sun path diagram for Istanbul, drawn as editable Rhino curves and points. Download Weather fetches the EPW that matches its Station panel, Weather converts it to a weather object, and Sun Path reads latitude, longitude and time zone from it. Outputs are daily sun arcs (by default June 21, March 20 and December 21), one analemma per clock hour, a horizon compass circle and a text report, centred on the origin. Swap the station to move the diagram to another city, set Radius, North and Arc Days to suit your model, or wire sun vectors to plot sample positions.
panel = Panel("Istanbul")
weather = DownloadWeather(Station=panel)  # -> EPWFile, Logs, Stations, Station, ExtraFiles, SiteLatitude, SiteLongitude
weather_2 = Weather(EPWFilePath=weather.EPWFile)
sunpath = SunPath(Weather=weather_2, Latitude=0, Longitude=0, TimeZone=0, Center=Point(0, 0, 0), Radius=100, North=0)  # -> Arcs, Analemmas, Suns, Compass, Report
