# Grasshopper definition WeatherMorphing.ghx (Grasshopper 1.0.8)
# plug-ins: Outdoor, Eddy3D, Eddy3D-Radiance

select_template = SelectTemplate()
# Description: Morphs a present-day Atlanta weather file into future-climate files and sets baseline and result side by side. Download Weather supplies the baseline EPW; Morph Weather passes it to the Future Weather Generator, using a File Path to the generator jar and Morph Settings (engine-default interpolation and uncertainty, 8 threads). A List Item picks one morphed file, and two Deconstruct Weather components expose dry-bulb temperature, relative humidity, wind speed and direction, solar angles and hour of year for each. Needs Java 17+ and the jar, which Eddy3D does not ship. Run starts off, and a full run takes minutes to hours.
eddy3d_setup = Eddy3DSetup(Open=False)
download_weather = DownloadWeather(Station="Atlanta")  # -> EPWFile, Logs, Stations, Station, ExtraFiles, SiteLatitude, SiteLongitude
morph_settings = MorphSettings(
    Ensemble=True,
    Interpolation="Engine default",
    Uncertainty="Engine default",
    WinterShift=0,
    SummerShift=0,
    PresentDay=False,
    Threads="8")
file_path = FilePath("/Users/patrickkastner/Desktop/Temp/FutureWeatherGenerator-CMIP6-Global-v5.0.0.jar")
morph_weather = MorphWeather(EPW=download_weather.EPWFile, Settings=morph_settings, FWGJar=file_path, Run=False)  # -> EPWFiles, Labels, Available, Logs
list_item = ListItem(List=morph_weather.EPWFiles, Index=0, Wrap=True)
panel = Panel([morph_weather.Logs, morph_weather.EPWFiles, morph_weather.Labels, morph_weather.Available])
deconstruct_weather = DeconstructWeather(
    Weather=list_item,
    Series="""Dry Bulb Temperature
Relative Humidity
Wind Speed
Wind Direction
Solar Elevation
Solar Azimuth
Hour of Year""")  # -> DryBulbTemperature, RelativeHumidity, WindSpeed, WindDirection, SolarElevation, SolarAzimuth, HourOfYear
deconstruct_weather_2 = DeconstructWeather(
    Weather=download_weather.EPWFile,
    Series="""Dry Bulb Temperature
Relative Humidity
Wind Speed
Wind Direction
Solar Elevation
Solar Azimuth
Hour of Year""")  # -> DryBulbTemperature, RelativeHumidity, WindSpeed, WindDirection, SolarElevation, SolarAzimuth, HourOfYear
panel_2 = Panel(deconstruct_weather.DryBulbTemperature)
panel_3 = Panel(deconstruct_weather_2.DryBulbTemperature)
