# Grasshopper definition Noise.ghx (Grasshopper 1.0.8)
# plug-ins: Eddy3D-Noise, Outdoor

boolean_toggle = BooleanToggle(True)
site_picker = SitePicker(
    SitePickerAddress="36, East 14th Street, Union Square, Manhattan Community Board 5, Manhattan, New York County, New York, 10003, United States",
    SitePickerLat=40.735204,
    SitePickerLon=-73.991737)  # -> Latitude, Longitude, Address
lidar_site = LiDARSite(
    Latitude=site_picker.Latitude,
    Longitude=site_picker.Longitude,
    Size="200",
    Source="Auto",
    Roads=True,
    Run=boolean_toggle,
    LidarSiteInputLayoutVersion=4)  # -> PointCloud, Footprints, Domain, Frame, Report, TreeCrowns, LayerOutlines, LayerNames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
roads_from_osm = RoadsFromOSM(Latitude=site_picker.Latitude, Longitude=site_picker.Longitude, Radius="200", Fetch=True)  # -> Sources, Roads, Log
city_surface = CitySurface(
    PointCloud=lidar_site.PointCloud,
    Footprints=lidar_site.Footprints,
    Domain=lidar_site.Domain,
    CloudOffset=Vector(0, 0, 0),
    LayerOutlines=lidar_site.LayerOutlines,
    LayerNames=lidar_site.LayerNames,
    Flatten=lidar_site.Flatten,
    LayerRoughness=lidar_site.LayerRoughness,
    LayerPercentile=0.5,
    RoofPercentile=0.9,
    GroundSpacing="5",
    Smoothing=2,
    LoD="LoD 2.2",
    Buffer=0,
    RoofHints=lidar_site.RoofHints,
    Engine="Auto",
    Run=boolean_toggle,
    CitySurfaceInputLayoutVersion=8)  # -> Terrain, Buildings, Layers, LayerNames, Surface, RoofHeights, Report, LayerRoughness, TreeCrowns, LowVegetation
noise_receivers = NoiseReceivers(
    Buildings=city_surface.Buildings,
    Centre=Point(0, 0, 0),
    Radius="200",
    Spacing="5",
    Height=1.5,
    StoreyHeight=3,
    FacadeSpacing=5,
    Roofs=False)  # -> Receivers, GroundPoints, FacadePoints, RoofPoints
noise_run = NoiseRun(
    Sources=roads_from_osm.Sources,
    Receivers=noise_receivers.Receivers,
    Buildings=city_surface.Buildings,
    Terrain=city_surface.Terrain,
    Ground="Mixed",
    CellSize="5",
    Engine="GPU",
    Run=True,
    NoiseRunInputLayoutVersion=2)  # -> Result, Lden, Lnight, Points, Summary
noise_map = NoiseMap(Result=noise_run.Result, Metric="Lden")  # -> GroundMesh, FacadeMesh, Points, Values, Colors, LegendLabels, LegendColors, RoofMesh
mesh_join = MeshJoin(Meshes=[noise_map.GroundMesh, noise_map.FacadeMesh])
scalar_field_viewer = ScalarFieldViewer(Values=noise_map.Values, DisplayMode="Heatmap Mesh", Mesh=mesh_join, PointSize=4, ColorMap="Spectral")  # -> Geometry, Colors, Range
flex_legend = FlexLegend(
    Values=noise_map.Values,
    Points=noise_map.Points,
    MetricType="custom",
    ColorMap="Spectral",
    Title="Lden",
    Contours="Bands",
    Plane=PlaneXY(0, 0, 0),
    Units="db(A)",
    LabelStyle="Text",
    Offset=0.5,
    Smoothing=0,
    Aggregate="Mean",
    HighlightTop=0,
    AnalysisMesh=mesh_join,
    FlexLegendInputLayoutVersion=4)  # -> LegendMesh, LegendPoints, LegendValues, FieldMesh, Colors, ResolvedRange, Contours, ContourValues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
