# Grasshopper definition 3_SimpleWindAnalysis.ghx (Grasshopper 1.0.8)
# plug-ins: Eddy3D

# ----
# 1. Geometry &
# Boundary Conditions
number_slider = Slider(0, range=0..100)
abl = ABLFlow(WindDirections=number_slider)

select = SelectTemplate()

# ----
# 2. Simulation Domain
cluster = Cluster_2()
dombox = BoxDomain(Buildings=cluster, BoundaryCondition=abl, CellSize=Slider(10, range=0..10))  # -> Domain, PreviewMesh

# ----
# 3. Mesh & Simulation
panel = Panel("3_SimpleWindAnalysis")
mset = MeshSettings(
    BuildingMinLevel="2",
    BuildingMaxLevel="3",
    FeatureLevel="3",
    BoundingBoxLevel=0,
    GroundLevel="2",
    BoundaryLayers=1,
    CellsBetweenLevels=4,
    MeshMode=4,
    Preset=1)
rset = RunSettings(
    Iterations="600",
    WriteInterval=20,
    TimestepsToKeep=3,
    TurbulenceModel=1,
    RelaxationFactors=3,
    NumericalSchemes=1,
    PotentialFlowInit=False,
    AgeOfAir=False,
    CPUCores="6",
    DebugDiagnostics=False,
    SIMPLEC=False)
windsim = WindSimulation(
    SimulationDomain=dombox.Domain,
    WorkingDirectory=panel,
    MeshSettings=mset,
    RunSettings=rset,
    RunMeshing=Button(),
    MakeTrees=False,
    RunSimulation=Button(),
    SelectedEngine=1)  # -> SimulationResult, MeshDone, SimDone, MeshRemainingTime, SimulationRemainingTime
residuals = VisualizeResiduals(Result=windsim.SimulationResult, Plot=Button(), ResidualViewerTarget=0)

reslive = LiveResiduals(Result=windsim.SimulationResult, Live=True, WindDirection=-1)

# ----
# 4. Probing points & probing
panel_2 = Panel("2")
unit_z = UnitZ(Factor=panel_2)
brep = Brep(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)
move = Move(Geometry=brep, Motion=unit_z)  # -> Geometry, Transform
brep_to_grid_points = BrepToGridPoints(Geometry=move.Geometry, Spacing=Slider(2, range=0..10), Run=True)  # -> Points, Status
probing = Probing(
    Result=windsim.SimulationResult,
    ProbingPoints=brep_to_grid_points.Points,
    NameOfInstance="ttt",
    InterpolationScheme=3,
    NameOfField=0,
    Run=Button())  # -> ProbingPoints, ProbingResult

# ----
# 5. Post-processing
# 5.1. Paraview
# 5.2. Wind vectors
vectors = Data(probing.ProbingResult)
points = Data(probing.ProbingPoints)
paraview = Paraview(Result=windsim.SimulationResult, Run=Button())
cluster_2 = Cluster(data=vectors)  # -> S, E, data_3
gradient = Gradient(
    LowerLimit=cluster_2.S,
    UpperLimit=5,
    Parameter=cluster_2.data_3,
    stops=[0.103: RGB(0, 0, 255), 0.22: RGB(0, 170, 255), 0.305: RGB(0, 255, 255), 0.398: RGB(0, 255, 188), 0.504: RGB(0, 255, 106), 0.605: RGB(91, 255, 0), 0.699: RGB(184, 255, 0), 0.799: RGB(255, 255, 0), 0.898: RGB(255, 170, 0)])
amplitude = Amplitude(Vector=vectors, Amplitude=Slider(3, range=0..10))
vdisex = VectorDisplayEx(Point=points, Vector=amplitude, Colour=gradient, Width=Slider(2, range=0..10))

# ----
# 6. Clean
button = Button()
clean = CleanDirectories(ResultDirectory=panel, Mode=2, Run=button)

# ==== cluster Cluster
data = ClusterInput()
data_2 = Data(data)
data_3 = ClusterOutput(data_2)
bnd = Bounds(Numbers=data_2)
dedomain = DeconstructDomain(Domain=bnd)  # -> Start, End
S = ClusterOutput(dedomain.Start)
E = ClusterOutput(dedomain.End)

# ==== cluster Cluster_2
geo = Geometry([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])
mesh = Mesh(geo)
mjoin = MeshJoin(Meshes=mesh)
M = ClusterOutput(mjoin)
