# Grasshopper definition 5_PressureOnBuildingFacade.ghx (Grasshopper 1.0.8)
# plug-ins: Eddy3D

panel = Panel("https://energyplus-weather.s3.amazonaws.com/asia_wmo_region_2/IND/IND_Ahmedabad.426470_IWEC/IND_Ahmedabad.426470_IWEC.epw")

# ----
# 1. Geometry &
# Boundary Conditions
panel_2 = Panel("""0
45
90
135
180
225
270
320""")

cluster = Cluster_2()
abl = ABLFlow(WindDirections=panel_2, WeatherFile=panel)

# ----
# 2. Simulation Domain
number_slider = Slider(40, range=0..1000)

domcyl = CylindricalDomain(
    Buildings=cluster,
    BoundaryCondition=abl,
    CellSize="15",
    InnerSize=number_slider,
    OuterRadius=Slider(519, range=0..1000),
    Height=Slider(80, range=0..1000),
    RadialMultiplier=2,
    XDivisions=1)  # -> Domain, PreviewMesh

# ----
# 3. Mesh & Simulation
button = Button()

wind_simulation = WindSimulation(
    SimulationDomain=domcyl.Domain,
    WorkingDirectory="/Users/patrickkastner/Eddy3D/Cases",
    RunMeshing=Button(),
    MakeTrees=False,
    RunSimulation=button,
    SelectedEngine=0)  # -> SimulationResult, MeshDone, SimDone, MeshETA, SimETA
qrmesh = QuadRemesh(Geometry=cluster, Settings={aqc=True, as=50, dhe=True, gci=0, null=False, pme=2, sa=0, tqc=2000})
demesh = DeconstructMesh(Mesh=qrmesh)  # -> Vertices, Faces, Colours, Normals

# ----
# 4.2. Probing points & probing
panel_3 = Panel("pressure100")

probing = Probing(
    Result=wind_simulation.SimulationResult,
    ProbingPoints=demesh.Vertices,
    NameOfInstance=panel_3,
    InterpolationScheme=2,
    NameOfField=1,
    Run=Button())  # -> ProbingPoints, ProbingResult

# ----
# 6. Clean
button_2 = Button()
clean = CleanDirectories(ResultDirectory=wind_simulation.SimulationResult, Mode=0, Run=button_2)

# ----
# 5. Post-processing
# 5.1. Change wind direction
number_slider_2 = Slider(6, range=0..7)
branch = TreeBranch(Tree=probing.ProbingResult, Path=number_slider_2, MaintainPaths=True)
cluster_2 = Cluster(data=branch)  # -> S, E, data_3
gradient = Gradient(
    LowerLimit="-1",
    UpperLimit="1",
    Parameter=cluster_2.data_3,
    stops=[0.103: RGB(0, 0, 255), 0.22: RGB(0, 170, 255), 0.305: RGB(0, 255, 255), 0.398: RGB(0, 255, 188), 0.504: RGB(0, 255, 106), 0.605: RGB(91, 255, 0), 0.699: RGB(184, 255, 0), 0.799: RGB(255, 255, 0), 0.898: RGB(255, 170, 0)])
conmesh = ConstructMesh(Vertices=demesh.Vertices, Faces=demesh.Faces, Colours=gradient)

# ==== cluster Cluster
data = ClusterInput()
data_2 = Data(data)
data_3 = ClusterOutput(data_2)
bnd = Bounds(Numbers=data_2)
dedomain = DeconstructDomain(Domain=bnd)  # -> Start, End
S = ClusterOutput(dedomain.Start)
E = ClusterOutput(dedomain.End)

# ==== cluster Cluster_2
geo = Geometry([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])
mesh = Mesh(geo)
mjoin = MeshJoin(Meshes=mesh)
M = ClusterOutput(mjoin)
