# Grasshopper definition FluidX3D.ghx (Grasshopper 1.0.8)
# plug-ins: Eddy3D-LBM, Outdoor, Eddy3D-FluidX3D

# Description: Purpose: Wind around buildings on the GPU, watched live in the viewport.
# Fidelity: Engineering - transient lattice-Boltzmann CFD, not validated for this site; FluidX3D's licence excludes commercial use.
# Method: LBM Case with FluidX3D Run Settings: 2 m grid, 720 s simulated, ABL inflow of 5 m/s at 10 m.
# Result: FluidX3D Live View colours a probe mesh while it runs; Scalar and Vector Field Viewers show probed values.
# Needs: Eddy3D Setup > LBM CFD (FluidX3D), built locally; needs a GPU. Runtime: minutes.
# Edit: Geometry, grid spacing, simulated time, inflow.
atmospheric_boundary_layer = AtmosphericBoundaryLayer(
    ReferenceHeight=10,
    RoughnessLengthZ0=1,
    GroundHeight=0,
    TurbulentKEK=0.015,
    TurbulentEpsilonΕ=0.135,
    TurbulentOmegaΩ=100,
    TerrainType="Custom (z0 input)",
    InletProfile="Log law (Richards & Hoxey)",
    DisplacementHeight=0,
    AblOutputLayoutVersion=2)  # -> BoundaryConditions, WindVectors
fluidx3d_run_settings = FluidX3DRunSettings(
    Memory=0,
    SimTime="720",
    ExportInterval=10,
    GroundZ=0,
    Interactive=False,
    GridSpacing="4",
    Live=False,
    LiveHeight=1.75,
    SyntheticTurbulence=True,
    Warmup=0,
    Averaging=0,
    IntegralLength=0,
    Settle=True,
    FluidX3DRunSettingsInputLayoutVersion=2)
geometry = Geometry([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])
panel = Panel(fluidx3d_run_settings)
lbm_case = LBMCase(
    CaseName="Case",
    ABL=atmospheric_boundary_layer.BoundaryConditions,
    Buildings=geometry,
    Settings=fluidx3d_run_settings,
    Write=False,
    Clear=False,
    AutoName="nimble-gecko-grove-mirror",
    LbmCaseInputLayoutVersion=2)  # -> Logs, Case, Domain, Folder
unit_z = UnitZ(Factor=1)
lbm_run = LBMRun(Case=lbm_case.Case, Run=False, LbmInputLayoutVersion=7, LbmShowSolverWindow=False)  # -> Logs, Case, Domain, Folder, Progress, Done, Remaining, SimulatedTime, MaxSpeed
quad_remesh_settings = QuadRemeshSettings(
    TargetCount=Slider(10000, range=0..10000),
    AdaptiveSize=0,
    AdaptiveCount=False,
    HardEdges=False,
    SeamEdges=0,
    Symmetry=0,
    GuideCurves=0)
deconstruct_brep = DeconstructBrep(Brep=lbm_run.Domain)  # -> Faces, Edges, Vertices
list_item = ListItem(List=deconstruct_brep.Faces, Index=Slider(4, range=0..10), Wrap=True)
move = Move(Geometry=list_item, Motion=unit_z)  # -> Geometry, Transform
quad_remesh = QuadRemesh(Geometry=move.Geometry, Settings=quad_remesh_settings)
deconstruct_mesh = DeconstructMesh(Mesh=quad_remesh)  # -> Vertices, Faces, Colours, Normals
probe = Probe(
    Case=lbm_run.Case,
    Points=deconstruct_mesh.Vertices,
    Field="U",
    Time="latestTime",
    Run=True,
    BakeTimeHistory=False,
    CullHugeVectors=True,
    CullInvalid=True,
    ShowCulled=False,
    ShowRegion=False)  # -> Values, TimeSteps, SubResults, Points
fluidx3d_live_view = FluidX3DLiveView(
    Case=lbm_run.Case,
    Mesh=quad_remesh,
    Live=True,
    MaxSpeed=0,
    AvgWindow=360,
    Source="VTK frames",
    Appearance="Velocity + LIC",
    MaxSpeedup=1.5,
    Video=False)  # -> Mesh, Speeds, Time, Status, Histogram; disabled
mesh = Mesh(fluidx3d_live_view.Mesh)
vector_field_viewer = VectorFieldViewer(
    Points=deconstruct_mesh.Vertices,
    Velocity=probe.Values,
    DisplayMode="Vector Field",
    Scale=1,
    ColorMap="Viridis",
    SeedCount=120,
    ArrowheadScaling="Fixed",
    VectorPlane="3D")  # -> Geometry, Colors, Range
scalar_field_viewer = ScalarFieldViewer(
    Points=deconstruct_mesh.Vertices,
    Values=probe.Values,
    DisplayMode="Heatmap Mesh",
    Mesh=quad_remesh,
    PointSize=4,
    ColorMap="Viridis")  # -> Geometry, Colors, Range
