# Grasshopper definition LiveTunnel2D.ghx (Grasshopper 1.0.8)
# plug-ins: Eddy3D-LBM, Outdoor, Eddy3D

boolean_toggle = BooleanToggle(True)
site_picker = SitePicker(
    SitePickerAddress="36, East 14th Street, Union Square, Manhattan Community Board 5, Manhattan, New York County, New York, 10003, United States",
    SitePickerLat=40.735204,
    SitePickerLon=-73.991737)  # -> Latitude, Longitude, Address
select_template = SelectTemplate()
lidar_site = LiDARSite(
    Latitude=site_picker.Latitude,
    Longitude=site_picker.Longitude,
    Size="200",
    Source="Auto",
    Roads=True,
    Run=boolean_toggle,
    LidarSiteInputLayoutVersion=4)  # -> PointCloud, Footprints, Domain, Frame, Report, TreeCrowns, LayerOutlines, LayerNames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
geometry = Geometry(lidar_site.Footprints)
city_surface = CitySurface(
    PointCloud=lidar_site.PointCloud,
    Footprints=lidar_site.Footprints,
    Domain=lidar_site.Domain,
    CloudOffset=Vector(0, 0, 0),
    LayerOutlines=lidar_site.LayerOutlines,
    LayerNames=lidar_site.LayerNames,
    Flatten=lidar_site.Flatten,
    LayerRoughness=lidar_site.LayerRoughness,
    LayerPercentile=0.5,
    RoofPercentile=0.9,
    GroundSpacing="5",
    Smoothing=2,
    LoD="LoD 1.3",
    Buffer=0,
    RoofHints=lidar_site.RoofHints,
    Engine="GPU",
    Run=boolean_toggle,
    CitySurfaceInputLayoutVersion=8,
    ClayLook=True)  # -> Terrain, Buildings, Layers, LayerNames, Surface, RoofHeights, Report, LayerRoughness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
bounding_box = BoundingBox(Content=city_surface.Surface, Plane=PlaneXY(0, 0, 0), UnionBox=True)  # -> Box, Box_2
live_wind_tunnel = LiveWindTunnel(
    Context=city_surface.Terrain,
    Buildings=city_surface.Buildings,
    WindSpeed=2,
    WindDirection=Vector(1, 0, 0),
    CellSize=0,
    CutHeight=Slider(10, range=0..10),
    View="LIC",
    Live=Toggle(True),
    Average=0,
    Engine="Auto",
    Mean=True,
    Forces=False,
    Tunnel=bounding_box.Box)  # -> Field, Speed, Pressure, Vorticity, Force, Cd, Status
