# Grasshopper definition OpenLB.ghx (Grasshopper 1.0.8)
# plug-ins: Eddy3D-LBM, Outdoor

# Description: Purpose: Time-averaged pedestrian wind around buildings from lattice-Boltzmann LES.
# Fidelity: Engineering - OpenLB D3Q19 with Smagorinsky LES, not validated for this site.
# Method: LBM Case with LBM Run Settings: 6 m grid, GPU on, inflow jitter on; runtime tries Podman, then Docker, then native.
# Result: The time-averaged pedestrian-level wind field in a Vector Field Viewer beside the domain wireframe.
# Needs: Eddy3D Setup > LBM CFD (OpenLB); the GPU build needs NVIDIA. Runtime: minutes to hours.
# Edit: Geometry; Grid Spacing (halving it costs 8x the memory and about 16x the time).
site_picker = SitePicker(SitePickerAddress="Munich, Bavaria, Germany", SitePickerLat=48.137108, SitePickerLon=11.575382)  # -> Latitude, Longitude, Address
boolean_toggle = BooleanToggle(True)
lidar_site = LiDARSite(
    Latitude=site_picker.Latitude,
    Longitude=site_picker.Longitude,
    Size="100",
    Source="Bavaria (Germany)",
    Roads=False,
    Run=boolean_toggle,
    LidarSiteInputLayoutVersion=4)  # -> PointCloud, Footprints, Domain, Frame, Report, TreeCrowns, LayerOutlines, LayerNames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
city_surface = CitySurface(
    PointCloud=lidar_site.PointCloud,
    Footprints=lidar_site.Footprints,
    Domain=lidar_site.Domain,
    CloudOffset=Vector(0, 0, 0),
    LayerNames="Layer",
    Flatten=False,
    LayerPercentile=0.5,
    RoofPercentile=0.9,
    GroundSpacing=1,
    Smoothing=2,
    LoD="LoD 1.3",
    Buffer=0,
    Engine="Auto",
    Run=boolean_toggle,
    CitySurfaceInputLayoutVersion=8)  # -> Terrain, Buildings, Layers, LayerNames, Surface, RoofHeights, Report, LayerRoughness, TreeCrowns
atmospheric_boundary_layer = AtmosphericBoundaryLayer(
    ReferenceHeight=10,
    RoughnessLengthZ0=1,
    GroundHeight=0,
    TurbulentKEK=0.015,
    TurbulentEpsilonΕ=0.135,
    TurbulentOmegaΩ=100,
    TerrainType="Custom (z0 input)",
    InletProfile="Log law (Richards & Hoxey)",
    DisplacementHeight=0,
    AblOutputLayoutVersion=2)  # -> BoundaryConditions, WindVectors
lbm_run_settings = LBMRunSettings(
    GridSpacing="6",
    Warmup=60,
    Averaging="30",
    ProbeHeight=1.5,
    ProbeSpacing="6",
    GPU=True,
    Runtime="Auto",
    Jitter=True,
    JitterAmplitude=5,
    VegetationDrag=0.25,
    PerturbedInflow=False,
    Ensemble=5,
    VegetationDensity="Custom (Vegetation Drag input)",
    Ground="None (bounce-back)",
    DisplacementHeight=0,
    OutletSponge=0,
    SyntheticTurbulence=True,
    Settle=0,
    GroundHeatFlux=0,
    BuildingHeatFlux=0,
    AirTemperature=20,
    Refine=False,
    IntegralLength=0,
    InstantSnapshots=False)
geometry = Geometry(city_surface.Buildings)
cluster = Cluster(content=geometry)
lbm_case = LBMCase(
    CaseName="Case",
    ABL=atmospheric_boundary_layer.BoundaryConditions,
    Domain=cluster,
    Buildings=city_surface.Buildings,
    Terrain=city_surface.Terrain,
    Settings=lbm_run_settings,
    Write=False,
    Clear=False,
    AutoName="polite-narwhal-plateau-feather",
    LbmCaseInputLayoutVersion=2)  # -> Logs, Case, Domain, Folder
lbm_run = LBMRun(Case=lbm_case.Case, Run=False, LbmInputLayoutVersion=7, LbmShowSolverWindow=False)  # -> Logs, Case, Domain, Folder, Progress, Done, Remaining, SimulatedTime, MaxSpeed
panel = Panel([lbm_run.Progress, lbm_run.Remaining])
panel_2 = Panel(lbm_run.Logs)
lbm_field = LBMField(Case=lbm_run.Case, Refresh=Button())  # -> Points, Velocity, Speed, Status, Spread, Species, Concentration, TemperatureRise
vector_field_viewer = VectorFieldViewer(
    Points=lbm_field.Points,
    Velocity=lbm_field.Velocity,
    DisplayMode="LIC",
    Scale=1,
    ColorMap="Turbo",
    SeedCount=120,
    ArrowheadScaling="Fixed",
    VectorPlane="3D")  # -> Geometry, Colors, Range

# ==== cluster Cluster
content = ClusterInput()
bounding_box = BoundingBox(Content=content, Plane=PlaneXY(0, 0, 0), UnionBox=True)  # -> Box, Box_2
deconstruct_brep = DeconstructBrep(Brep=bounding_box.Box)  # -> Faces, Edges, Vertices
list_item = ListItem(List=deconstruct_brep.Faces, Index=Slider(4, range=0..10), Wrap=True)
area = Area(Geometry=list_item)  # -> Area, Centroid
scale = Scale(Geometry=bounding_box.Box, Center=area.Centroid, Factor="2")  # -> Geometry, Transform
geometry = ClusterOutput(scale.Geometry)
