# Grasshopper definition ML_Inference_Comfort.ghx (Grasshopper 1.0.8)
# plug-ins: Outdoor, Eddy3D

# Description: Purpose: Year-round pedestrian wind comfort classes around buildings, without running CFD.
# Fidelity: Screening, not CFD - confirm decisions with a Wind Study. Cite: Karadag and Kastner (Routledge, in press).
# Method: Yel 2.0 wind for 16 directions on a 2 m grid; Weibull fit per point against Istanbul weather; Lawson General criteria.
# Result: A comfort-class mesh and legend; roofs are classified where the model supplies roof speeds.
# Needs: Nothing to install; ML Model downloads Yel 2.0 on first use. Runtime: minutes.
# Edit: Buildings (three samples included), weather station, comfort metric (Lawson, Davenport or NEN 8100).
select = SelectTemplate()

# ---- group: Terrain- Do not change, try to center your geometry accordingly. / TERRAIN
srf = Surface(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)

# ----
token = FilePath("D:\GithubProjects\Conditional_Transformer\TokenHF\HF_Token.txt")
mlmodel = MLModel(Model="Yel 2.0", HFToken=token, Run=Toggle(True), MLModelInputLayoutVersion=2)  # -> Status, FilePath, Progress

# ---- group: Terrain- Do not change, try to center your geometry accordingly.
move = Move(Geometry=srf, Motion=Vector(0, 0, 1.8))  # -> Geometry, Transform
brep2grid = BrepToGridPoints(Geometry=move.Geometry, Spacing="2")  # -> Points, Vectors, Mesh, Status

# ---- group: Wind Speed
panel = Panel("5")

# ----
range = Range(Domain=Domain(0, 337.5), Steps=15)
abl = ABLFlow(
    WindDirections=range,
    WindSpeed=panel,
    ReferenceHeight=10,
    RoughnessLengthZ0=1,
    GroundHeight=0,
    TurbulentKEK=0.015,
    TurbulentEpsilonΕ=0.135,
    TurbulentOmegaΩ=100,
    TerrainType="Custom (z0 input)",
    InletProfile="Log law (Richards & Hoxey)",
    DisplacementHeight=0,
    AblOutputLayoutVersion=2)  # -> BoundaryConditions, WindVectors

comfort_metric = ValueList({"NEN8100 Comfort": 4, "NEN8100 Safety": 5, "Lawson General": 0, "Lawson LDDC": 1, "Lawson 2001": 2, "Davenport": 3}, selected="Lawson General")
weather = DownloadWeather(Station="istanbul", ChartMonthFrom=1, ChartMonthTo=12)  # -> EPWFile, Logs, Stations, Station, ExtraFiles, SiteLatitude, SiteLongitude

# ---- group: Geometry Input
list = ValueList({"Architectural Insitute of Japan - Case E": 0, "OpenFOAM - Wind Around Buildings": 1, "Eddy3D Validation Sample": 2}, selected="Architectural Insitute of Japan - Case E")
brep = Brep([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])
brep_2 = Brep([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])
brep_3 = Brep([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])
entwine = Entwine(Branch00=brep, Branch01=brep_2, Branch02=brep_3, FlattenInputs=True)  # -> simplify(Result)
branch = TreeBranch(Tree=entwine, Path=list, MaintainPaths=True)

# ---- group: Geometry Input / Buildings
brep_4 = Brep(branch)

# ---- group: Geometry Input (continued)
preview = CustomPreview(Geometry=brep_4, Material=ColourSwatch(SwatchColor=RGB(204, 204, 204)))

# ----
windpredict = WindPredictor(
    Points=brep2grid.Points,
    Buildings=brep_4,
    Model=mlmodel.FilePath,
    BoundaryConditions=abl.BoundaryConditions,
    PedestrianLevel=1.8,
    FilterMargin=0,
    Palette="jet",
    Interpolate="Smooth",
    Field="Velocity",
    Level="Roof Level",
    Radius=0.75,
    LegendScale=1,
    MeshType="Square",
    Engine="Auto",
    Run=True,
    WindPredictorInputLayoutVersion=2,
    WindPredictorOutputLayoutVersion=2)  # -> Points, Values, GridMesh, LegendMesh, LegendPoints, LegendValues, BoundaryConditions, ValuesRoof

windcomfortml = WindComfortPredictorML(
    Points=windpredict.Points,
    WindSpeeds=windpredict.Values,
    EPWPath=weather.EPWFile,
    ReferenceHeight=10,
    RoughnessLengthZ0=1,
    Metric=comfort_metric,
    Interpolate="True",
    FastModeMoM="True",
    BoundaryConditions=windpredict.BoundaryConditions,
    WindSpeedsRoof=windpredict.ValuesRoof,
    Buildings=brep_4)  # -> ComfortRank, ClassLetter, Class, ComfortMesh, LegendMesh, LegendPoints, LegendLetters, MetricName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
swatch = ColourSwatch(SwatchColor=RGB(0, 0, 0))
mesh = Mesh(windcomfortml.ComfortMesh)
mesh_2 = Mesh(windcomfortml.LegendMesh)
tag = TextTag3D(Location=windcomfortml.LegendPoints, Text=windcomfortml.CategoryExplanations, Size=11, Colour=swatch, Justification=8)
area = Area(Geometry=mesh_2)  # -> Area, Centroid
move_2 = Move(Geometry=area.Centroid, Motion=Vector(0, 50, 0))  # -> Geometry, Transform
tag_2 = TextTag3D(Location=move_2.Geometry, Text=windcomfortml.MetricName, Size=14, Colour=swatch, Justification=8)
