# Grasshopper definition MRT_Mixed.ghx (Grasshopper 1.0.8)
# plug-ins: Outdoor, Eddy3D-Radiance

number_slider = Slider(2, range=0..10)
# Description: Purpose: Annual mean radiant temperature at ground and building sensors, on the fast path.
# Fidelity: Screening - surfaces at air temperature; no Radiance or EnergyPlus.
# Method: MRT Surface tags ground and 22 context Breps; MRT Sensors on 2 m grids; MRT View Factors and MRT Solve with Atlanta weather.
# Result: A coloured MRT mesh, Text Tag values, and one sensor's sky dome in Fisheye View.
# Needs: Nothing to install; runs inside Rhino. Runtime: minutes.
# Edit: Ground and context Breps, weather station; press the two Buttons to run.
geo = Geometry(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)
context = Brep([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])

hoy = HourOfYear(
    StartMonth=Slider(5, range=1..12),
    StartDay=Slider(10, range=1..30),
    StartHour=Slider(13, range=0..23),
    EndMonth=Slider(10, range=1..12),
    EndDay=Slider(31, range=1..31),
    EndHour=Slider(23, range=0..23))  # -> HoursOfYear, DateTimes
calendar = Calendar(Day=24, Hour=15, Month=7)

preview = CustomPreview(Geometry=context, Material=ColourSwatch(SwatchColor=RGB(255, 255, 255)))
brepgrid = BrepGridPoints(Geometry=geo, Spacing=number_slider)  # -> Points, Vectors, Mesh, Status
brepgrid_2 = BrepGridPoints(Geometry=context, Spacing=number_slider)  # -> Points, Vectors, Mesh, Status
mrt_surface = MRTSurface(Geometry=geo, Simulated=True, PatchSize=3, LegacyOpaqueTrees=True)  # -> Surface, Mesh
mrt_surface_2 = MRTSurface(Geometry=context, Simulated=True, PatchSize=3, LegacyOpaqueTrees=True)  # -> Surface, Mesh
mrt_sensors = MRTSensors(Sensors=brepgrid.Points, Normal=brepgrid.Vectors, Height=1.1)  # -> Sensors, Points
mrt_sensors_2 = MRTSensors(Sensors=brepgrid_2.Points, Normal=brepgrid_2.Vectors, Height=0.5)  # -> Sensors, Points
boolean_toggle = BooleanToggle(True)
mrt_view_factors = MRTViewFactors(
    Surfaces=[mrt_surface_2.Surface, mrt_surface.Surface],
    Sensors=[mrt_sensors.Sensors, mrt_sensors_2.Sensors],
    SkyDomeSubdivisions="3 — 192 sky patches",
    Fidelity="Fast",
    Engine="Auto",
    Run=boolean_toggle)  # -> VFModel, SkyDome, Log
download_weather = DownloadWeather(Station="Istanbul", ChartMonthFrom=1, ChartMonthTo=12)  # -> EPWFile, Logs, Stations, Station, ExtraFiles, SiteLatitude, SiteLongitude
panel = Panel(mrt_view_factors.Log)
mrt_solve = MRTSolve(
    VFModel=mrt_view_factors.VFModel,
    EPW=download_weather.EPWFile,
    Engine="Native",
    Compute="Auto",
    Run=boolean_toggle,
    MrtSolveInputLayoutVersion=2)  # -> Probes, Result, Log
fisheye_view = FisheyeView(
    VFModel=mrt_view_factors.VFModel,
    Sensor=Slider(7583, range=0..10000),
    Radius=Slider(10, range=0..100),
    Rings="24",
    Display="Dome")  # -> Fisheye, SVF
geometry = Geometry(fisheye_view.Fisheye)
panel_2 = Panel(mrt_solve.Log)
deconstruct_mrt = DeconstructMRT(Result=mrt_solve.Result, Statistic="Mean", Radius=0.7, DeMrtOutputLayoutVersion=2)  # -> Mean, Min, Max, MRT, Mesh
entwine = Entwine(Branch00=brepgrid.Points, Branch01=brepgrid_2.Points, FlattenInputs=True)  # -> flatten(Result)

# ---- group: Mean
round = Round(Number=deconstruct_mrt.Mean)  # -> Nearest, Floor, Ceiling
tag = TextTag(Location=brepgrid.Points, Text=round.Nearest, Colour=ColourSwatch(SwatchColor=RGB(255, 255, 255)))

# ----
scalar_field_viewer = ScalarFieldViewer(
    Values=deconstruct_mrt.Mean,
    Points=entwine,
    DisplayMode="Heatmap Mesh",
    ColorMap="Viridis",
    Mesh=deconstruct_mrt.Mesh,
    Size=4,
    ScalarFieldViewerInputLayoutVersion=2)  # -> Geometry, Colors, Range
