# Grasshopper definition MRT_Radiance.ghx (Grasshopper 1.0.8)
# plug-ins: Outdoor, Eddy3D-Radiance

context = Brep([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])

# ---- group: Ground Surface
brep = Brep(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)

# ----
preview = CustomPreview(Geometry=context, Material=ColourSwatch(SwatchColor=RGB(255, 255, 255)))
data = Data([context, brep])
# Description: Purpose: Annual mean radiant temperature at ground sensors, with interreflected sun and computed surface temperatures.
# Fidelity: Engineering - Radiance shortwave plus EnergyPlus surface temperatures, not validated for this site.
# Method: One MRT component runs Radiance (Standard quality) and EnergyPlus; Brep Grid Points meshes ground and context at 2 m.
# Result: Annual mean MRT per probe, shown by Gradient and Text Tag.
# Needs: Eddy3D Setup > Comfort study (Radiance / EnergyPlus). Runtime: hours.
# Edit: Ground and context Breps, the EPW URL; turn Run on.
panel = Panel("Istanbul")
brep_grid_points = BrepGridPoints(Geometry=data, Spacing=Slider(2, range=0..10))  # -> Points, Vectors, Mesh, Status
download_weather = DownloadWeather(Station=panel, ChartMonthFrom=1, ChartMonthTo=12)  # -> EPWFile, Logs, Stations, Station, ExtraFiles, SiteLatitude, SiteLongitude
surface = MRTSurface(Geometry=brep, Simulated=True, PatchSize=3, LegacyOpaqueTrees=True)  # -> Surface, Mesh
mrt_settings = MRTSettings(
    SmallFaceCutoff=0.1,
    RadianceReflections=True,
    EnergyPlusSurfaces=True,
    EngineTimeout=60,
    RadianceQuality="Standard",
    Parallelize="Auto",
    FastMatrices=True,
    ShortwaveMethod="Two-Phase DDS",
    SunResolution="MF:4 · 2,305 suns",
    MrtSettingsInputLayoutVersion=3)
mrt_sensors = MRTSensors(Sensors=brep_grid_points.Mesh, Height=1.1)  # -> Sensors, Points
mrt = MRT(
    Surfaces=surface.Surface,
    Sensors=mrt_sensors.Sensors,
    EPW=download_weather.EPWFile,
    Settings=mrt_settings,
    Engine="Native",
    Compute="Auto",
    Run=False,
    AutoProject="sturdy-ferret-quay-umbrella",
    MrtInputLayoutVersion=4,
    MrtOutputLayoutVersion=3,
    ShowSkyDome=True)  # -> SkyDome, Probes, Result
mesh = Mesh(mrt.SkyDome)
deconstruct_mrt = DeconstructMRT(Result=mrt.Result, Statistic="Mean", Radius=0.75, DeMrtOutputLayoutVersion=2)  # -> Mean, Min, Max, MRT, Mesh
scalar_field_viewer = ScalarFieldViewer(
    Values=deconstruct_mrt.Mean,
    Points=mrt_sensors.Points,
    DisplayMode="Point Cloud",
    ColorMap="Viridis",
    Size=4,
    ScalarFieldViewerInputLayoutVersion=2)  # -> Geometry, Colors, Range
