# Grasshopper definition Sun_Hours.ghx (Grasshopper 1.0.8)
# plug-ins: Outdoor, Eddy3D, Eddy3D-Radiance

site_picker = SitePicker(
    SitePickerAddress="36, East 14th Street, Union Square, Manhattan Community Board 5, Manhattan, New York County, New York, 10003, United States",
    SitePickerLat=40.735204,
    SitePickerLon=-73.991737)  # -> Latitude, Longitude, Address
boolean_toggle = BooleanToggle(True)
panel = Panel("New York")
weather = DownloadWeather(Station="USA_NY_New.York-Central.Park.Obs-Belvedere.Castle.725053_TMYx.2004-2018", ChartMonthFrom=1, ChartMonthTo=12)  # -> EPWFile, Logs, Stations, Station, ExtraFiles, SiteLatitude, SiteLongitude
lidar_site = LiDARSite(
    Latitude=weather.SiteLatitude,
    Longitude=weather.SiteLongitude,
    Size="100",
    Source="Auto",
    Roads=True,
    Run=boolean_toggle,
    LidarSiteInputLayoutVersion=4,
    LidarSiteOutputLayoutVersion=2)  # -> PointCloud, Footprints, RoofHints, Domain, Trees, TreeCrowns, LayerOutlines, LayerNames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
city_surface = CitySurface(
    PointCloud=lidar_site.PointCloud,
    Footprints=lidar_site.Footprints,
    Domain=lidar_site.Domain,
    LayerOutlines=lidar_site.LayerOutlines,
    LayerNames=lidar_site.LayerNames,
    LayerRoughness=lidar_site.LayerRoughness,
    Flatten=lidar_site.Flatten,
    RoofHints=lidar_site.RoofHints,
    Engine="GPU",
    CloudOffset=Vector(0, 0, 0),
    LayerPercentile=0.5,
    RoofPercentile=0.9,
    GroundSpacing="5",
    Smoothing=2,
    Buffer=0,
    Run=boolean_toggle,
    CitySurfaceInputLayoutVersion=10,
    ClayLook=True)  # -> Terrain, Buildings, Layers, LayerNames, Surface, RoofHeights, Report, LayerRoughness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
mesh_join = MeshJoin(Meshes=flatten([city_surface.Surface, lidar_site.Furniture, lidar_site.Barriers, lidar_site.Trees]))
deconstruct_mesh = DeconstructMesh(Mesh=mesh_join)  # -> Vertices, Faces, Colours, Normals
weather_2 = Weather(EPWFilePath=weather.EPWFile)
sun_hours = SunHours(
    Context=mesh_join,
    Points=deconstruct_mesh.Vertices,
    Weather=weather_2,
    StartHour=0,
    EndHour=8760,
    Timestep=1,
    North=0,
    Offset=0.01,
    Engine="GPU",
    Date="Custom",
    SunHoursInputLayoutVersion=2)  # -> SunHours, Fraction, Colors, Report, MorningHours, AfternoonHours
flex_legend = FlexLegend(
    Values=sun_hours.SunHours,
    Points=deconstruct_mesh.Vertices,
    MetricType="sun hours",
    ColorMap="Viridis",
    Contours="Bands",
    Plane=PlaneXY(0, 0, 0),
    LabelStyle="Text",
    Offset=0.5,
    Smoothing=0,
    Aggregate="Mean",
    HighlightTop=0,
    AnalysisMesh=mesh_join,
    FlexLegendInputLayoutVersion=5)  # -> LegendMesh, LegendPoints, LegendValues, FieldMesh, Colors, ResolvedRange, Contours, ContourValues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
