# Grasshopper definition UTCI_surrogate.ghx (Grasshopper 1.0.8)
# plug-ins: Outdoor, Eddy3D, Eddy3D-Radiance

# ---- group: Weather File
panel = Panel("https://energyplus-weather.s3.amazonaws.com/north_and_central_america_wmo_region_4/USA/GA/USA_GA_Atlanta-Hartsfield-Jackson.Intl.AP.722190_TMY3/USA_GA_Atlanta-Hartsfield-Jackson.Intl.AP.722190_TMY3.epw")

# ---- group: Ground surface
cir = Circle(Plane=PlaneXY(0, 0, 0), Radius=60)
srf = Surface(cir)
brepgrid = BrepGridPoints(Geometry=srf, Spacing=2)  # -> Points, Vectors, Mesh, Status

# ----
download_weather = DownloadWeather(Search=panel)  # -> EPWFile, Logs, Stations

# ---- group: Buildings
context = Brep([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])
preview = CustomPreview(Geometry=context, Material=ColourSwatch(SwatchColor=RGB(255, 255, 255)))

# ---- group: Terrain (do not change)
cir_2 = Circle(Plane=PlaneXY(0, 0, 0), Radius=504)
Z = UnitZ(Factor=1.8)
srf_2 = Surface(cir_2)
move = Move(Geometry=srf_2, Motion=Z)  # -> Geometry, Transform

# ----
mlmodel = MLModel(Model="Yel 2.0", Run=Toggle(True), MLModelInputLayoutVersion=2)  # -> Status, FilePath, Progress
sensors = MRTSensors(Sensors=brepgrid.Points, Normal=Vector(0, 0, 1), Height=1.1)  # -> Sensors, Points
boolean_toggle = BooleanToggle(True)

# ---- group: EPW extracted values
calendar = Calendar(Day=20, Hour=15, Month=8)
panel_2 = Panel("1")
deweather = DeconstructWeather(Variables=download_weather.EPWFile, Series="""Dry Bulb Temperature
Relative Humidity
Wind Speed
Wind Direction""")  # -> DryBulbTemperature, RelativeHumidity, WindSpeed, WindDirection

# ---- group: EPW extracted values / hour of the year, index arrangement
subtraction = Subtraction(A=calendar, B=panel_2)

# ---- group: EPW extracted values (continued)
item = ListItem(List=deweather.DryBulbTemperature, Index=subtraction, Wrap=True)
item_2 = ListItem(List=deweather.RelativeHumidity, Index=subtraction, Wrap=True)
item_3 = ListItem(List=deweather.WindSpeed, Index=subtraction, Wrap=True)
item_4 = ListItem(List=deweather.WindDirection, Index=subtraction, Wrap=True)

# ---- group: Surrogate
brepgrid_2 = BrepGridPoints(Geometry=move.Geometry, Spacing=2)  # -> Points, Vectors, Mesh, Status
abl = AtmosphericBoundaryLayer(
    WindDirections=item_4,
    WindSpeed=item_3,
    ReferenceHeight=10,
    RoughnessLengthZ0=1,
    GroundHeight=0,
    TurbulentKEK=0.015,
    TurbulentEpsilonΕ=0.135,
    TurbulentOmegaΩ=100)  # -> BoundaryConditions, WindVectors, AirABLSettings
windpredict = WindPredictor(
    Points=brepgrid_2.Points,
    Buildings=context,
    Model=mlmodel.FilePath,
    BoundaryConditions=abl.BoundaryConditions,
    PedestrianLevel=1.8,
    FilterMargin=100,
    Palette="jet",
    Interpolate="Smooth",
    Field="Velocity",
    Level="Pedestrian Level",
    SelectionPoints=brepgrid.Points,
    Radius=0.75,
    LegendScale=1,
    MeshType="Square",
    Run=True)  # -> X, Y, Values, GridMesh, LegendMesh, LegendPoints, LegendValues, BoundaryConditions, ValuesRoof
mesh = Mesh(windpredict.GridMesh)

# ----
data = Data([context, srf])
preview_2 = CustomPreview(Geometry=context, Material=ColourSwatch(SwatchColor=RGB(255, 255, 255)))
mrt_surface = MRTSurface(Geometry=context, Type="Building", Simulated=True, PatchSize=3)  # -> Surface, Mesh

mrt_view_factors = MRTViewFactors(
    Surfaces=mrt_surface.Surface,
    Sensors=sensors.Sensors,
    SkyDomeSubdivisions="5 — 3,072 sky patches",
    Fidelity="Balanced",
    Run=boolean_toggle)  # -> VFModel, SkyDome, Log
mrt_solve = MRTSolve(VFModel=mrt_view_factors.VFModel, EPW=download_weather.EPWFile, Engine="Native", Run=boolean_toggle)  # -> Probes, Result, Log

deconstruct_mrt = DeconstructMRT(Result=mrt_solve.Result, HOY=calendar, Statistic="Mean", Radius=0.75, DeMrtOutputLayoutVersion=2)  # -> Mean, Min, Max, MRT, Mesh

# ---- group: UTCI calculation
comfort = ThermalComfort(AirTemperature=item, RelativeHumidity=item_2, WindSpeed=windpredict.Values, MRT=deconstruct_mrt.MRT, ActiveMetric="UTCI")  # -> Value, Stress, Details, MetricType
utcilegend = UTCILegend(
    Values=comfort.Value,
    Plane=PlaneXY(0, 0, 0),
    Size=2,
    GroundSurface=srf,
    Offset=5,
    SmoothColors=False,
    CircleRadius=0.75,
    SensorPoints=brepgrid.Points,
    Scale=2.2,
    Metric=comfort.MetricType,
    UtciLegendShowValues=False)  # -> Colors, Categories, LegendMesh, LabelPoints, Labels, UTCIMesh, CenteredLabels
bnd = Bounds(Numbers=comfort.Value)
panel_3 = Panel(comfort.Value)
dedomain = DeconstructDomain(Domain=bnd)  # -> Start, End
mesh_2 = Mesh(utcilegend.LegendMesh)
mesh_3 = Mesh(utcilegend.UTCIMesh)
gradient = Gradient(
    LowerLimit=dedomain.Start,
    UpperLimit=dedomain.End,
    Parameter=comfort.Value,
    stops=[0: RGB(48, 18, 59), 0.0294: RGB(56, 40, 112), 0.0588: RGB(63, 62, 156), 0.0882: RGB(68, 82, 193), 0.118: RGB(70, 102, 221), 0.147: RGB(71, 122, 241)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])
round = Round(Number=panel_3)  # -> Nearest, Floor, Ceiling
tag = TextTag3D(
    Location=utcilegend.LabelPoints,
    Text=utcilegend.Labels,
    Size=1,
    Colour=ColourSwatch(SwatchColor=RGB(0, 0, 0)),
    Justification=8)
tag_2 = TextTag(Location=brepgrid.Points, Text=round.Nearest, Colour=ColourSwatch(SwatchColor=RGB(0, 0, 0)))
