# Grasshopper definition BoxDomain.ghx (Grasshopper 1.0.8)
# plug-ins: Outdoor, Eddy3D

box_domain = BoxDomain(
    CellSize="100",
    FrontExtension=-1,
    BackExtension=-1,
    SideExtension=-1,
    TopExtension=-1,
    RefinementBoxExtension=-1,
    WakeRefinement=3)
mesh_settings = MeshSettings(
    RefinementBoxLevel=2,
    BuildingSurfaceLevel=2,
    BuildingFeatureLevel=2,
    GroundSurfaceLevel=3,
    LayerCount=4,
    AddLayers=False,
    Snap=True,
    GradingStrengthHorizontal="25",
    GradingStrengthVertical="25",
    AdaptiveGrading=True,
    CellsBetweenLevels=-1)
atmospheric_boundary_layer = AtmosphericBoundaryLayer(
    ReferenceHeight=10,
    RoughnessLengthZ0=1,
    GroundHeight=0,
    TurbulentKEK=0.015,
    TurbulentEpsilonΕ=0.135,
    TurbulentOmegaΩ=100,
    TerrainType="Custom (z0 input)",
    AblOutputLayoutVersion=2)  # -> BoundaryConditions, WindVectors
run_settings = RunSettings(
    Iterations=1000,
    WriteInterval=20,
    KeepTimeSteps=3,
    TurbulenceModel="realizableKE",
    CPUCount="12",
    SolverAlgorithm="SIMPLE",
    AgeOfAir=False,
    Numerics="0,0.5,0.5",
    PotentialFoamInit=True,
    WarmUpIterations=-1,
    FieldMonitors=False,
    PedestrianAverage=False,
    PressureCoefficient=False,
    Convergence=0.0001,
    AutoStopOnPlateau=False,
    Duration=-1,
    TimeStep=-1,
    MaxCourant=-1,
    AveragingWindow=-1,
    PressureSolver="GAMG",
    LaplacianScheme="auto",
    MeshQualityPreset="auto",
    PedestrianHeight=1.75)  # -> RunSettings, DebugLogs
geometry = Geometry([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])
# Description: Rectangular-domain wind study around sample buildings and dense tree canopy. Atmospheric Boundary Layer sets the inflow; Outdoor Case combines it with Box Domain, Mesh Settings, Run Settings (realizable k-epsilon, SIMPLE, 12 CPUs) and the Containerized engine, needing Podman or Docker. Run meshes and solves. Probe samples U at a point cloud; Wind Field Viewer draws arrows and feeds its range to Flex Legend. Export to Visualizer writes a CSV for viz.eddy3d.com, and Streamlines traces flow from a seed line. Meshing Progress, Parse Case Logs, Plot Residuals and Live Residuals follow the run. Swap in your own geometry and probe points.
geometry_2 = Geometry(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)
tree = Tree(Geometry=geometry_2, Type="dense")
outdoor_case = OutdoorCase(
    BoundaryConditions=atmospheric_boundary_layer.BoundaryConditions,
    DomainParameters=box_domain,
    Buildings=geometry,
    Trees=tree,
    MeshSettings=mesh_settings,
    RunSettings=run_settings.RunSettings,
    Engine="Containerized",
    Write=False,
    ClearCase=False,
    AutoName="merry-lemur-dune-quill",
    AutoWrapGeometry=False,
    OutdoorCaseInputLayoutVersion=5,
    PreviewBuildings=False,
    PreviewDimensions=True,
    PreviewGrid3D=False,
    PreviewGroundGrid=True,
    PreviewRefinementBox=True,
    PreviewWindArrows=True,
    RepairGeometry=True)  # -> Logs, WriteLogs, Case, Domain, RefinementBox, Buildings
plot_residuals = PlotResiduals(Case=outdoor_case.Case, Plot=False, ResidualViewerTarget=0)
live_residuals = LiveResiduals(Case=outdoor_case.Case, Live=True, DirectionDegrees=-1)
meshing_progress = MeshingProgress(Case=outdoor_case.Case, Live=True)  # -> Progress, Phase, Done, Status
panel = Panel([meshing_progress.Progress, meshing_progress.Phase, meshing_progress.Status, meshing_progress.Done])
open_in_paraview = OpenInParaView(Case=outdoor_case.Case, Open=False, ComfortMetric=1, DirectionIndex=-1, ParaviewInputLayoutVersion=2, Streamlines=True)
run = Run(
    Case=outdoor_case.Case,
    Mesh=False,
    CreateZones=False,
    Simulate=False,
    RunAll=False,
    Parallel=True,
    DirectionIndex=-1,
    ShowZones=True)
parse_case_logs = ParseCaseLogs(Case=outdoor_case.Case, Run=False)  # -> LogSummary, Errors, Warnings
panel_2 = Panel([parse_case_logs.LogSummary, parse_case_logs.Errors, parse_case_logs.Warnings])
geometry_3 = Geometry([Point(-80.2763443, -188.6662445, 0), Point(-80.2763443, -185.6625214, 0), Point(-80.2763443, -182.6588135, 0), Point(-80.2763443, -179.6550903, 0), Point(-80.2763443, -176.6513672, 0), Point(-80.2763443, -173.6476593, 0)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])
probe = Probe(
    Case=outdoor_case.Case,
    Points=geometry_3,
    Field="U",
    Run=False,
    AutoProbeName="polite-octopus-glade-needle",
    BakeTimeHistory=False,
    CullHugeVectors=True,
    CullInvalid=True,
    ShowRegion=False)  # -> Values, TimeSteps, SubResults
export_to_visualizer = ExportToVisualizer(
    Points=geometry_3,
    Velocity=probe.Values,
    FilePath=outdoor_case.Case,
    FileName="Export",
    GroundZ=0,
    Write=Button(),
    VizExportInputLayoutVersion=2)
geometry_4 = Geometry(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)
streamlines = Streamlines(Case=outdoor_case.Case, SeedLine=geometry_4, SeedCount=24, Direction="Both", ColorMap="Viridis", Run=Button())  # -> Streamlines, Speeds, SubResults, Colors, Range
wind_field_viewer = WindFieldViewer(
    Points=geometry_3,
    Velocity=probe.Values,
    DisplayMode="Vector Field",
    Scale=1,
    MaxSpeed="4",
    ColorMap="Turbo",
    SeedCount=120,
    ArrowheadScaling="Fixed",
    VectorPlane="3D")  # -> Geometry, Colors, Range
flex_legend = FlexLegend(
    Range=wind_field_viewer.Range,
    Plane=PlaneXY(0, 0, 0),
    ColorMap="Viridis",
    Case=outdoor_case.Case,
    Offset=0.5,
    MetricType="wind speed",
    LabelStyle="Text",
    Contours="Off",
    Smoothing=0,
    Aggregate="Mean",
    HighlightTop=0,
    FlexLegendInputLayoutVersion=3)  # -> LegendMesh, LegendPoints, LegendValues, FieldMesh, Colors, ResolvedRange, Contours, ContourValues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
