# Grasshopper definition CylinderDomain.ghx (Grasshopper 1.0.8)
# plug-ins: Outdoor, Eddy3D

# Description: Purpose: Pedestrian-level wind around an Atlanta site for every prevailing wind direction, solved on one mesh.
# Fidelity: Engineering - steady RANS, not validated for this site. Cite: Kastner and Dogan (2020), cylindrical mesh.
# Method: Steady RANS in OpenFOAM on a cylindrical mesh; Wind Rose Cluster reduces the EPW to up to 8 directions and speeds.
# Result: Velocity U probed 1.5 m above terrain, one direction per slider step.
# Needs: Eddy3D Setup > (U)RANS CFD (OpenFOAM). Runtime: hours.
# Edit: Station, site coordinates, buildings, tree zones; toggle Fetch for land cover and terrain.
panel = Panel("Atlanta")
# Related work to cite:
# 
# Kastner, P., & Dogan, T. (2020).
# A cylindrical meshing methodology
#  for annual urban computational fluid dynamics
# simulations. Journal of Building Performance Simulation, 13(1), 59-68.
# 
# Kastner, P., & Dogan, T. (2022).
# Eddy3D: A toolkit for decoupled
# outdoor thermal comfort simulations
# in urban areas. Building and Environment, 212, 108639.
download_weather = DownloadWeather(Station=panel, ChartMonthFrom=1, ChartMonthTo=12)  # -> EPWFile, Logs, Stations, Station, ExtraFiles, SiteLatitude, SiteLongitude
deconstruct_weather = DeconstructWeather(
    Weather=download_weather.EPWFile,
    Series="""Dry Bulb Temperature
Relative Humidity
Wind Speed
Wind Direction
Solar Elevation
Solar Azimuth
Hour of Year
Latitude
Longitude""")  # -> DryBulbTemperature, RelativeHumidity, WindSpeed, WindDirection, SolarElevation, SolarAzimuth, HourOfYear, Latitude, Longitude
panel_2 = Panel(download_weather.SiteLatitude)
panel_3 = Panel(download_weather.SiteLongitude)
wind_rose_cluster = WindRoseCluster(
    Directions=deconstruct_weather.WindDirection,
    Budget="8",
    WindSpeeds=deconstruct_weather.WindSpeed,
    Series="""Wind Directions
Wind Speeds""")  # -> WindDirections, WindSpeeds
atmospheric_boundary_layer = AtmosphericBoundaryLayer(
    WindDirections=wind_rose_cluster.WindDirections,
    WindSpeed=wind_rose_cluster.WindSpeeds,
    ReferenceHeight=10,
    RoughnessLengthZ0=1,
    GroundHeight=0,
    TurbulentKEK=0.015,
    TurbulentEpsilonΕ=0.135,
    TurbulentOmegaΩ=100,
    TerrainType="Custom (z0 input)",
    InletProfile="Log law (Richards & Hoxey)",
    DisplacementHeight=0,
    AblOutputLayoutVersion=2)  # -> BoundaryConditions, WindVectors
cylinder_domain = CylinderDomain(
    CoreCellSize=40,
    InnerCoreSize=-1,
    OuterRadius=-1,
    Height=-1,
    RadialMultiplier=2,
    CoreDivisions=1,
    RefinementBoxExtension=-1,
    RadialGrading=1,
    CoreRoundness=0.65,
    VerticalGrading=1)
run_settings = RunSettings(
    Iterations="300",
    WriteInterval=20,
    KeepTimeSteps=3,
    TurbulenceModel="realizableKE",
    CPUCount=-1,
    SolverAlgorithm="SIMPLE",
    AgeOfAir=False,
    Numerics="0,0.5,0.5",
    PotentialFoamInit=True,
    WarmUpIterations=-1,
    FieldMonitors=False,
    PedestrianAverage=False,
    PressureCoefficient=False,
    Convergence=0.0001,
    AutoStopOnPlateau=False,
    Duration=-1,
    TimeStep=-1,
    MaxCourant=-1,
    AveragingWindow=-1,
    PressureSolver="GAMG",
    LaplacianScheme="auto",
    MeshQualityPreset="auto",
    PedestrianHeight=1.75,
    Guideline="None")  # -> RunSettings, DebugLogs
land_cover_roughness = LandCoverRoughness(
    Latitude="33.78145186480617",
    Longitude="-84.37722219362138",
    Radius="700",
    TerrainRadius="700",
    Anchor=PlaneXY(0, 0, 0),
    RefinementLevel=2,
    ColorBy="Land use",
    Fetch=Toggle(True),
    LandZ0InputLayoutVersion=3)  # -> GroundZones, Boundaries, RoughnessLengths, LandCover, Terrain, SiteElevation, ColoredMesh
geometry = Geometry(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)
geometry_2 = Geometry(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)
geometry_3 = Geometry(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)
geometry_4 = Geometry([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])
geometry_5 = Geometry(land_cover_roughness.Terrain)
tree = Tree(Geometry=geometry, Type="live oak")
tree_2 = Tree(Geometry=geometry_2, Type="dense")
tree_3 = Tree(Geometry=geometry_3, Type="silver birch")
curve = Curve(land_cover_roughness.Boundaries)
outdoor_case = OutdoorCase(
    BoundaryConditions=atmospheric_boundary_layer.BoundaryConditions,
    DomainParameters=cylinder_domain,
    Buildings=geometry_4,
    Trees=[tree, tree_2, tree_3],
    Terrain=land_cover_roughness.Terrain,
    RunSettings=run_settings.RunSettings,
    GroundRoughness=land_cover_roughness.GroundZones,
    Engine="Containerized",
    Write=False,
    ClearCase=False,
    AutoName="merry-lemur-dune-quill",
    AutoWrapGeometry=False,
    OutdoorCaseInputLayoutVersion=5,
    PreviewBuildings=False,
    PreviewDimensions=True,
    PreviewGrid3D=True,
    PreviewGroundGrid=True,
    PreviewRefinementBox=True,
    PreviewWindArrows=True,
    RepairGeometry=True)  # -> Logs, WriteLogs, Case, Domain, RefinementBox, Buildings
meshing_progress = MeshingProgress(Case=outdoor_case.Case, Live=True)  # -> Progress, Phase, Done, Status
plot_residuals = PlotResiduals(Case=outdoor_case.Case, Plot=False, ResidualViewerTarget=0)
live_residuals = LiveResiduals(Case=outdoor_case.Case, Live=True, DirectionDegrees=-1)
parse_case_logs = ParseCaseLogs(Case=outdoor_case.Case, Run=True)  # -> LogSummary, Errors, Warnings
run = Run(
    Case=outdoor_case.Case,
    Mesh=False,
    CreateZones=False,
    Simulate=False,
    RunAll=False,
    Parallel=True,
    DirectionIndex=-1,
    ShowZones=True)
open_in_paraview = OpenInParaView(Case=outdoor_case.Case, Open=False, ComfortMetric=1, DirectionIndex=-1, ParaviewInputLayoutVersion=2, Streamlines=True)
mesh_intersection = MeshIntersection(MeshesA=geometry_5, MeshesB=outdoor_case.Domain)
panel_4 = Panel(parse_case_logs.LogSummary)
refine = Refine(Mesh=mesh_intersection, Level=1)
deconstruct_mesh = DeconstructMesh(Mesh=refine)  # -> Vertices, Faces, Colours, Normals
unit_z = UnitZ(Factor="1.75")
number_slider = Slider(2, range=0..7)
move = Move(Geometry=deconstruct_mesh.Vertices, Motion=unit_z)  # -> Geometry, Transform
probe = Probe(
    Case=outdoor_case.Case,
    Points=move.Geometry,
    Field="U",
    Time="latestTime",
    Run=False,
    AutoProbeName="sunny-ferret-mesa-compass",
    BakeTimeHistory=False,
    CullHugeVectors=True,
    CullInvalid=True,
    ShowRegion=False)  # -> Values, TimeSteps, SubResults
tree_branch = TreeBranch(Tree=simplify(probe.Values), Path=number_slider, MaintainPaths=True)
tree_branch_2 = TreeBranch(Tree=simplify(probe.Values), Path=number_slider, MaintainPaths=True)
cluster = Cluster(data=tree_branch_2)  # -> S, E, data_3
gradient = Gradient(
    LowerLimit=cluster.S,
    UpperLimit=cluster.E,
    Parameter=cluster.data_3,
    stops=[0.103: RGB(0, 0, 255), 0.22: RGB(0, 170, 255), 0.305: RGB(0, 255, 255), 0.398: RGB(0, 255, 188), 0.504: RGB(0, 255, 106), 0.605: RGB(91, 255, 0), 0.699: RGB(184, 255, 0), 0.799: RGB(255, 255, 0), 0.898: RGB(255, 170, 0)])
vdisex = VectorDisplayEx(Point=deconstruct_mesh.Vertices, Vector=tree_branch, Colour=gradient, Width=Slider(6, range=0..10))

# ==== cluster Cluster
data = ClusterInput()
data_2 = Data(data)
data_3 = ClusterOutput(data_2)
bnd = Bounds(Numbers=data_2)
dedomain = DeconstructDomain(Domain=bnd)  # -> Start, End
S = ClusterOutput(dedomain.Start)
E = ClusterOutput(dedomain.End)
